# Grasshopper definition samplesite.gh (Grasshopper 1.0.8)
# plug-ins: Pufferfish, Human, Groundhog, Bifocals, Ibex

# ----
# Part1 - Reading HDF5 Files from HEC-RAS to Rhino
# 1 HDF5 File Reader
panel = Panel("C:\96_RhinoEnv\Rhino-HECRAS\HDF5Reader\SRWD_NashvilleSite_.p01.hdf")
hecras_reader = Python3Script(HDF_PATH=panel)  # -> out
# ---------- hecras_reader: Python ----------
# requirements: h5py
import h5py
import numpy as np
import scriptcontext as sc
sc.sticky["HDF_PATH"] = HDF_PATH

with h5py.File(HDF_PATH, "r") as f:
    print(list(f.keys()))

FACEPOINT_INDEX_PATH = "Geometry/2D Flow Areas/2D_Domain/Faces FacePoint Indexes"
sc.sticky["FACEPOINT_INDEX_PATH"] = FACEPOINT_INDEX_PATH

FACEPOINT_COORD_PATH = "Geometry/2D Flow Areas/2D_Domain/FacePoints Coordinate"
sc.sticky["FACEPOINT_COORD_PATH"] = FACEPOINT_COORD_PATH

TIME_DATE_STAMP_PATH = "Results/Unsteady/Output/Output Blocks/Base Output/Unsteady Time Series/Time Date Stamp"
sc.sticky["TIME_DATE_STAMP_PATH"] = TIME_DATE_STAMP_PATH

SHEAR_PATH = "Results/Unsteady/Output/Output Blocks/Base Output/Unsteady Time Series/2D Flow Areas/2D_Domain/Face Shear Stress"
sc.sticky["SHEAR_PATH"] = SHEAR_PATH

CELL_FACEPOINT_INDEXES_PATH = "Geometry/2D Flow Areas/2D_Domain/Cells FacePoint Indexes"
sc.sticky["CELL_FACEPOINT_INDEXES_PATH"] = CELL_FACEPOINT_INDEXES_PATH
# ---------- end hecras_reader ----------
panel_2 = Panel(hecras_reader)

# ----
# Part2 - Sending Terrain as .tiff from Rhino to HECRAS
# 2.1 Become 2.5D Mesh
panel_3 = Panel("BaseTopo")
dpipeline = DynamicGeometryPipeline(
    LayerFilter=panel_3,
    TypeFilter="Mesh",
    NameFilter="*",
    GroupByLayer=False,
    GroupByType=False,
    IncludeHidden=True,
    IncludeLocked=True,
    enableFullPath=True,
    listenToAttributes=True)
dpipeline_2 = DynamicGeometryPipeline(
    LayerFilter="BdryCrv",
    TypeFilter="Curve",
    NameFilter="*",
    GroupByLayer=False,
    GroupByType=False,
    IncludeHidden=True,
    IncludeLocked=True,
    enableFullPath=True,
    listenToAttributes=True)
# 2.3 Could we automate HEC-RAS Topo ?
panel_4 = Panel("-400")

# ---- group: Clipping Plane
# 2.2 2.5d MESH TO .tiff
panel_5 = Panel("0,0,405")
xy = XYPlane(Origin=panel_5)

# ----
Z = UnitZ(Factor=panel_4)

# ---- group: Geometry Node
geo = Geometry(dpipeline)

# ---- group: Optional
crv = Curve(dpipeline_2)

# ---- group: Res
num = Number("5")

# ----
# LiveUpdate
# Run
toggle = BooleanToggle(True)
button = Button()

# ----
# 5 HDF5 - Dataset Reader
# 2 HDF5 - Timestamp Reader
list = ValueList({"Water Level": "water_level", "Velocity": "velocity", "Shear Stress": "shear_stress"}, selected="Velocity")
number_slider = Slider(5, range=0..20)
py3 = Python3Script(DatasetKey=list, Run=button)  # -> out, DatasetKey, DatasetTitle, DatasetUnit, SelectedPaths, DatasetType, Status
# ---------- py3: Python ----------
# requirements: h5py
import h5py
import scriptcontext as sc
import Grasshopper.Kernel.Special as gh_special


# ------------------------------------------------------------
# Sticky keys
# ------------------------------------------------------------

HDF_PATH_KEY = "HDF_PATH"
FLOW_AREA_NAMES_KEY = "FLOW_AREA_NAMES"


# ------------------------------------------------------------
# Cache keys
# ------------------------------------------------------------

CACHE_DATASET_TYPE_KEY = "DATASET_TOGGLE_DATASET_TYPE"
CACHE_SELECTED_PATHS_KEY = "DATASET_TOGGLE_SELECTED_PATHS"
CACHE_STATUS_KEY = "DATASET_TOGGLE_STATUS"
CACHE_DATASET_KEY_KEY = "DATASET_TOGGLE_DATASET_KEY"
CACHE_DATASET_STRING_KEY = "DATASET_TOGGLE_DATASET_STRING"


# ------------------------------------------------------------
# HEC-RAS result base path
# ------------------------------------------------------------

BASE_RESULT_PATH = (
    "Results/Unsteady/Output/Output Blocks/Base Output/"
    "Unsteady Time Series/2D Flow Areas"
)


# ------------------------------------------------------------
# Dataset registry
# ------------------------------------------------------------

DATASET_REGISTRY = {
    "water_level": {
        "label": "Water Surface",
        "dataset_name": "Water Surface",
        "dataset_type": "cell"
    },

    "shear_stress": {
        "label": "Face Shear Stress",
        "dataset_name": "Face Shear Stress",
        "dataset_type": "face"
    },

    "velocity": {
        "label": "Face Velocity",
        "dataset_name": "Face Velocity",
        "dataset_type": "face"
    }
}


# ------------------------------------------------------------
# Helpers
# ------------------------------------------------------------

def normalize_dataset_key(dataset_key):
    if dataset_key is None:
        return ""
    return str(dataset_key).strip().lower()


def normalize_flow_area_names(flow_area_names):

    if flow_area_names is None:
        return []

    if isinstance(flow_area_names, str):
        s = flow_area_names.strip()

        if s == "":
            return []

        return [s]

    names = []

    try:
        for name in flow_area_names:

            if name is None:
                continue

            s = str(name).strip()

            if s != "":
                names.append(s)

    except:
        pass

    return names


def get_all_flow_area_names(hdf_file):
    base_group = hdf_file[BASE_RESULT_PATH]
    return list(base_group.keys())


def get_dataset_path(flow_area_name, dataset_name):
    return BASE_RESULT_PATH + "/" + flow_area_name + "/" + dataset_name


def get_dataset_string_from_value_list(dataset_key):

    dataset_string = dataset_key
    all_labels = []
    all_values = []

    try:
        input_param = None

        for p in ghenv.Component.Params.Input:
            if p.Name == "DatasetKey":
                input_param = p
                break

        if input_param is None:
            return dataset_string, all_labels, all_values

        if len(input_param.Sources) == 0:
            return dataset_string, all_labels, all_values

        source = input_param.Sources[0]

        if not isinstance(source, gh_special.GH_ValueList):
            return dataset_string, all_labels, all_values

        value_list = source

        for item in value_list.ListItems:

            label = item.Name
            value = item.Expression

            clean_value = value.strip()

            if clean_value.startswith('"') and clean_value.endswith('"'):
                clean_value = clean_value[1:-1]

            all_labels.append(label)
            all_values.append(clean_value)

            if clean_value == dataset_key:
                dataset_string = label

    except:
        pass

    return dataset_string, all_labels, all_values


def resolve_dataset(dataset_key):

    HDFPath = sc.sticky.get(HDF_PATH_KEY)

    if HDFPath is None or str(HDFPath).strip() == "":
        return None, [], "Error: HDF_PATH not found."

    key = normalize_dataset_key(dataset_key)

    if key not in DATASET_REGISTRY:

        valid_keys = ", ".join(DATASET_REGISTRY.keys())

        return (
            None,
            [],
            "Error: invalid DatasetKey. Use one of: " + valid_keys
        )

    spec = DATASET_REGISTRY[key]

    dataset_name = spec["dataset_name"]
    dataset_type = spec["dataset_type"]

    flow_area_names = sc.sticky.get(FLOW_AREA_NAMES_KEY, None)
    selected_flow_areas = normalize_flow_area_names(flow_area_names)

    selected_paths = []
    missing_paths = []

    with h5py.File(HDFPath, "r") as f:

        if len(selected_flow_areas) == 0:
            selected_flow_areas = get_all_flow_area_names(f)

        for flow_area in selected_flow_areas:

            dataset_path = get_dataset_path(flow_area, dataset_name)

            if dataset_path in f:
                selected_paths.append(dataset_path)
            else:
                missing_paths.append(dataset_path)

    if len(selected_paths) == 0:

        status = "Error: no valid dataset path found."

        if len(missing_paths) > 0:
            status += " Missing: " + "; ".join(missing_paths[:3])

        return dataset_type, [], status

    status = (
        "OK: DatasetKey={0}; DatasetType={1}; FlowAreas={2}"
    ).format(
        key,
        dataset_type,
        len(selected_flow_areas)
    )

    return dataset_type, selected_paths, status


# ------------------------------------------------------------
# Grasshopper execution
# ------------------------------------------------------------

DatasetType = sc.sticky.get(CACHE_DATASET_TYPE_KEY, None)
SelectedPaths = sc.sticky.get(CACHE_SELECTED_PATHS_KEY, [])
Status = sc.sticky.get(CACHE_STATUS_KEY, "Waiting. Press Run.")
DatasetTitle = sc.sticky.get(CACHE_DATASET_STRING_KEY, DatasetKey)

AllLabels = []
AllValues = []

try:

    DatasetTitle, AllLabels, AllValues = get_dataset_string_from_value_list(
        DatasetKey
    )

    if Run:
        
        DatasetType, SelectedPaths, Status = resolve_dataset(DatasetKey)

        sc.sticky[CACHE_DATASET_TYPE_KEY] = DatasetType
        sc.sticky[CACHE_SELECTED_PATHS_KEY] = SelectedPaths
        sc.sticky[CACHE_STATUS_KEY] = Status
        sc.sticky[CACHE_DATASET_KEY_KEY] = normalize_dataset_key(DatasetKey)
        sc.sticky[CACHE_DATASET_STRING_KEY] = DatasetTitle 
        DatasetString=DatasetKey
    else:

        cached_key = sc.sticky.get(CACHE_DATASET_KEY_KEY, None)

        if cached_key is None:
            Status = "Waiting. Press Run."

        else:
            Status = "Cached: {0}. Press Run to reload.".format(cached_key)

except Exception as e:

    DatasetType = None
    SelectedPaths = []
    DatasetString = DatasetKey
    AllLabels = []
    AllValues = []

    Status = "Error: " + str(e)
# ---------- end py3 ----------
hecras_reader_2 = Python3Script(Run=button)  # -> Timestamps, TimeCount, TimeIndices, Status
# ---------- hecras_reader_2: Python ----------
# requirements: h5py
import h5py
import scriptcontext as sc


# -----------------------------
# Sticky keys / global constants
# -----------------------------

HDF_PATH_KEY = "HDF_PATH"
TIME_DATE_STAMP_PATH_KEY = "TIME_DATE_STAMP_PATH"

HECRAS_TIMESTAMPS_KEY = "HECRAS_TIMESTAMPS"
HECRAS_TIME_COUNT_KEY = "HECRAS_TIME_COUNT"
HECRAS_TIME_INDICES_KEY = "HECRAS_TIME_INDICES"


# -----------------------------
# Helpers
# -----------------------------

def decode_hdf5_string(value):
    """
    Convert HDF5 byte/string values into clean Python strings.
    """
    if isinstance(value, bytes):
        return value.decode("utf-8", errors="replace")
    return str(value)


def read_timestamps(hdf_path, timestamp_path):
    """
    Read HEC-RAS timestamps from HDF5.

    Returns:
        list[str]: Readable timestamp strings.
    """
    with h5py.File(hdf_path, "r") as hdf_file:
        raw_timestamps = hdf_file[timestamp_path][()]

    timestamps = [decode_hdf5_string(item) for item in raw_timestamps]
    return timestamps


# -----------------------------
# Default outputs
# -----------------------------

timestamps = []
time_count = 0
time_indices = []
status_message = "Idle: press Run to read timestamps."


# -----------------------------
# Grasshopper execution
# -----------------------------

try:
    if Run:
        hdf_path = sc.sticky.get(HDF_PATH_KEY)
        timestamp_path = sc.sticky.get(TIME_DATE_STAMP_PATH_KEY)

        if not hdf_path:
            raise ValueError("{} not found in sc.sticky.".format(HDF_PATH_KEY))

        if not timestamp_path:
            raise ValueError("{} not found in sc.sticky.".format(TIME_DATE_STAMP_PATH_KEY))

        timestamps = read_timestamps(hdf_path, timestamp_path)

        time_count = len(timestamps)
        time_indices = list(range(time_count))

        sc.sticky[HECRAS_TIMESTAMPS_KEY] = timestamps
        sc.sticky[HECRAS_TIME_COUNT_KEY] = time_count
        sc.sticky[HECRAS_TIME_INDICES_KEY] = time_indices

        status_message = "Success: loaded {} timestamps from HDF5.".format(time_count)

    else:
        timestamps = sc.sticky.get(HECRAS_TIMESTAMPS_KEY, [])
        time_count = sc.sticky.get(HECRAS_TIME_COUNT_KEY, 0)
        time_indices = sc.sticky.get(HECRAS_TIME_INDICES_KEY, [])

        if time_count > 0:
            status_message = "Cached: {} timestamps available. Press Run to reload.".format(time_count)
        else:
            status_message = "Idle: press Run to read timestamps."

except Exception as error:
    timestamps = []
    time_count = 0
    time_indices = []
    status_message = "Failed: {}".format(error)


# -----------------------------
# Grasshopper outputs
# -----------------------------

Status = status_message
Timestamps = timestamps
TimeCount = time_count
TimeIndices = time_indices
# ---------- end hecras_reader_2 ----------
panel_6 = Panel(hecras_reader_2.TimeIndices)
panel_7 = Panel(hecras_reader_2.TimeCount)
panel_8 = Panel(hecras_reader_2.Status)
panel_9 = Panel(py3.Status)
panel_10 = Panel(py3.SelectedPaths)
panel_11 = Panel(hecras_reader_2.Timestamps)
panel_12 = Panel(py3.DatasetType)
panel_13 = Panel(py3.DatasetKey)
panel_14 = Panel(py3.DatasetTitle)
py3_2 = Python3Script(x=py3.DatasetKey)  # -> out, a
# ---------- py3_2: Python ----------
"""Grasshopper Script"""
if x == "velocity":
    a=0
elif x == "water_level":
    a=1
elif x == "shear_stress":
    a=2
# ---------- end py3_2 ----------
item = ListItem(List=py3.SelectedPaths, Index=0, Wrap=True)
py3_3 = Python3Script(x=py3.DatasetType)  # -> out, a
# ---------- py3_3: Python ----------
"""Grasshopper Script"""
a = 0 if x == "face" else 1
# ---------- end py3_3 ----------

geo_2 = Geometry([<mesh referenced from the Rhino model>, <extrusion referenced from the Rhino model>])
# ScaleBar
panel_15 = Panel("0 To 2.4")
panel_16 = Panel("C:\96_RhinoEnv\dinofish\examples\samplesite\mesh.txt")
mesh = Mesh(geo_2)
mjoin = MeshJoin(Meshes=mesh)

# ----
# Become 2.5D Mesh
brec = BoundingRectangle(Geometry=geo, Plane=PlaneXY(0, 0, 0), Axis=0, Slide=0, Union=True)  # -> Bounding, DimensionX, DimensionY
division = Division(A=brec.DimensionX, B=num)
division_2 = Division(A=brec.DimensionY, B=num)
brep = Brep(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)
Z_2 = UnitZ(Factor=Slider(200, range=0..1000))
move = Move(Geometry=brep, Motion=Z_2)  # -> Geometry, Transform
divide = DivideDomain²(Domain=move.Geometry, UCount=division, VCount=division_2)
subsrf = Isotrim(Surface=move.Geometry, Domain=divide)
mjoin_2 = MeshJoin(Meshes=subsrf)
Z_3 = UnitZ(Factor=1)
neg = Negative(Value=Z_3)
demesh = DeconstructMesh(Mesh=mjoin_2)  # -> Vertices, Faces, Colours, Normals
meshray = MeshRay(Mesh=mjoin, Point=demesh.Vertices, Direction=neg)  # -> Point, Hit
pt = Point(meshray.Point)
project = Project(Geometry=demesh.Vertices, Plane=xy)  # -> Geometry, Transform
combine = CombineData(Input0=pt, Input1=project.Geometry)  # -> Result, Index
conmesh = ConstructMesh(Vertices=combine.Result, Faces=demesh.Faces)

mesh_2 = Mesh(conmesh)
move_2 = Move(Geometry=mesh_2, Motion=Z)  # -> Geometry, Transform
mesh2txt = Python3Script(Mesh=move_2.Geometry, Export_Path=panel_16, Run=Button())  # -> Status; inputs Mesh: Mesh
# ---------- mesh2txt: Python ----------
import os

# Inputs:
# Mesh: Rhino.Geometry.Mesh
# Export_Path: string
# Run: Button input / Boolean pulse

# Outputs:
# Status
# Count
# Preview

Status = "Click Run button to export mesh vertices."
Count = 0
Preview = None

if Run:
    if Mesh is None:
        Status = "No mesh input."
    elif not Export_Path:
        Status = "No export path provided."
    else:
        try:
            folder = os.path.dirname(Export_Path)
            if folder and not os.path.exists(folder):
                os.makedirs(folder)

            if not Export_Path.lower().endswith(".txt"):
                Export_Path += ".txt"

            lines = []
            verts = Mesh.Vertices

            for i in range(verts.Count):
                pt = verts[i]
                lines.append("{0} {1} {2}".format(pt.X, pt.Y, pt.Z))

            with open(Export_Path, "w") as f:
                f.write("\n".join(lines))

            Count = len(lines)
            Preview = lines[:10]
            Status = "Exported {0} vertices to: {1}".format(Count, Export_Path)

        except Exception as e:
            Status = "Export failed: {0}".format(e)
else:
    Status = "Idle. Click Run button to export."
# ---------- end mesh2txt ----------
txt2geotiff = Python3Script(
    Delimited_Text_File=panel_16,
    Output_Tif_Path="C:\96_RhinoEnv\dinofish\examples\samplesite\mesh_dem.tif",
    Cell_Size="1",
    EPSG="2274",
    Run=Button())  # -> Status
# ---------- txt2geotiff: Python ----------
"""Grasshopper Script"""

import os
import sys
import re
import importlib


# Recommended tested versions:
# numpy>=1.24
# pandas>=2.0
# scipy>=1.10
# rasterio>=1.3

REQUIRED_PACKAGES = {
    "numpy": "1.24.0",
    "pandas": "2.0.0",
    "scipy": "1.10.0",
    "rasterio": "1.3.0",
}


def parse_version(v):
    """
    Convert version string like '1.24.3' into comparable tuple (1, 24, 3).
    Keeps only numeric parts.
    """
    parts = re.findall(r"\d+", str(v))
    return tuple(int(p) for p in parts[:3])


def check_packages(required_packages):
    """
    Returns:
        ok: bool
        message: str
    """
    messages = []
    ok = True

    try:
        from importlib.metadata import version, PackageNotFoundError
    except Exception:
        try:
            from importlib_metadata import version, PackageNotFoundError
        except Exception:
            return False, "Could not access importlib.metadata for package version checking."

    for package_name, min_version in required_packages.items():
        try:
            installed_version = version(package_name)

            if parse_version(installed_version) < parse_version(min_version):
                ok = False
                messages.append(
                    "{} installed: {}, required: >= {}".format(
                        package_name,
                        installed_version,
                        min_version
                    )
                )
            else:
                messages.append(
                    "{} OK: {}".format(package_name, installed_version)
                )

        except PackageNotFoundError:
            ok = False
            messages.append(
                "{} missing. Required: >= {}".format(
                    package_name,
                    min_version
                )
            )

    return ok, "\n".join(messages)


Status = "Idle. Click Run to create GeoTIFF."

package_ok, package_message = check_packages(REQUIRED_PACKAGES)

if not package_ok:
    Status = (
        "Missing or incompatible packages.\n\n"
        "{}\n\n"
        "Install in Rhino Python package manager:\n"
        "numpy>=1.24\n"
        "pandas>=2.0\n"
        "scipy>=1.10\n"
        "rasterio>=1.3"
    ).format(package_message)

elif not Run:
    Status = (
        "Ready. Required packages found:\n\n"
        "{}\n\n"
        "Click Run to create GeoTIFF."
    ).format(package_message)

else:
    try:
        import numpy as np
        import pandas as pd
        import rasterio
        from rasterio.transform import from_origin
        from scipy.interpolate import griddata

        input_txt = Delimited_Text_File
        output_tif = Output_Tif_Path
        cell_size = float(Cell_Size)
        epsg = int(EPSG)
        nodata = -9999.0

        if not input_txt or not os.path.exists(input_txt):
            Status = "Input text file does not exist: {}".format(input_txt)

        elif not output_tif:
            Status = "No output GeoTIFF path provided."

        else:
            if not output_tif.lower().endswith((".tif", ".tiff")):
                output_tif += ".tif"

            folder = os.path.dirname(output_tif)
            if folder and not os.path.exists(folder):
                os.makedirs(folder)

            df = pd.read_csv(
                input_txt,
                sep=r"\s+",
                header=None,
                names=["x", "y", "z"]
            )

            df = df.dropna(subset=["x", "y", "z"])

            if len(df) == 0:
                Status = "Input file has no valid XYZ rows."

            else:
                x = df["x"].to_numpy(dtype=float)
                y = df["y"].to_numpy(dtype=float)
                z = df["z"].to_numpy(dtype=float)

                x_min, x_max = x.min(), x.max()
                y_min, y_max = y.min(), y.max()

                cols = int(np.ceil((x_max - x_min) / cell_size)) + 1
                rows = int(np.ceil((y_max - y_min) / cell_size)) + 1

                grid_x = x_min + np.arange(cols) * cell_size
                grid_y = y_max - np.arange(rows) * cell_size

                xx, yy = np.meshgrid(grid_x, grid_y)

                zz = griddata(
                    points=(x, y),
                    values=z,
                    xi=(xx, yy),
                    method="linear",
                    fill_value=nodata
                ).astype("float32")

                transform = from_origin(
                    x_min,
                    y_max,
                    cell_size,
                    cell_size
                )

                with rasterio.open(
                    output_tif,
                    "w",
                    driver="GTiff",
                    height=rows,
                    width=cols,
                    count=1,
                    dtype="float32",
                    crs="EPSG:{}".format(epsg),
                    transform=transform,
                    nodata=nodata,
                    compress="lzw"
                ) as dst:
                    dst.write(zz, 1)

                Status = (
                    "GeoTIFF created successfully.\n\n"
                    "Output: {}\n"
                    "Rows: {}\n"
                    "Cols: {}\n"
                    "Cell size: {}\n"
                    "EPSG: {}\n"
                    "Extent:\n"
                    "  xmin={}\n"
                    "  xmax={}\n"
                    "  ymin={}\n"
                    "  ymax={}\n\n"
                    "Package check:\n{}"
                ).format(
                    output_tif,
                    rows,
                    cols,
                    cell_size,
                    epsg,
                    x_min,
                    x_max,
                    y_min,
                    y_max,
                    package_message
                )

    except Exception as e:
        Status = "GeoTIFF export failed:\n{}".format(e)
# ---------- end txt2geotiff ----------
panel_17 = Panel(mesh2txt)
panel_18 = Panel(txt2geotiff)

# ----
# 3 HDF5 - Geometry - CellMeshBuilder
button_2 = Button()
py3_4 = Python3Script(Run=button)  # -> out, CellMesh, HECRASCellIndexes, SkippedCellReports, MeshVertexFacePointIndexes, Status
# ---------- py3_4: Python ----------
# requirements: h5py
import h5py
import scriptcontext as sc
import Rhino.Geometry as rg


# -----------------------------
# Sticky keys / global constants
# -----------------------------

HDF_PATH_KEY = "HDF_PATH"
FACEPOINT_COORD_PATH_KEY = "FACEPOINT_COORD_PATH"
CELL_FACEPOINT_INDEXES_PATH_KEY = "CELL_FACEPOINT_INDEXES_PATH"

HECRAS_CELL_MESH_KEY = "HECRAS_CELL_MESH"
HECRAS_CELL_POINT_LOOPS_KEY = "HECRAS_CELL_POINT_LOOPS"
HECRAS_MESH_VERTEX_FACEPOINT_INDEXES_KEY = "HECRAS_MESH_VERTEX_FACEPOINT_INDEXES"

# New:
# For each Rhino MeshFace, store the original HEC-RAS Cell index.
# Length should equal CellMesh.Faces.Count.
HECRAS_MESH_FACE_CELL_INDEXES_KEY = "HECRAS_MESH_FACE_CELL_INDEXES"

# Debug cache
HECRAS_RAW_CELL_COUNT_KEY = "HECRAS_RAW_CELL_COUNT"
HECRAS_VALID_CELL_COUNT_KEY = "HECRAS_VALID_CELL_COUNT"
HECRAS_MESH_FACE_COUNT_KEY = "HECRAS_MESH_FACE_COUNT"
HECRAS_TRIANGULATED_CELL_COUNT_KEY = "HECRAS_TRIANGULATED_CELL_COUNT"
HECRAS_SKIPPED_CELL_COUNT_KEY = "HECRAS_SKIPPED_CELL_COUNT"
HECRAS_SKIPPED_CELL_REPORTS_KEY = "HECRAS_SKIPPED_CELL_REPORTS"


# -----------------------------
# HDF5 readers
# -----------------------------

def read_paths_from_sticky():
    hdf_path = sc.sticky.get(HDF_PATH_KEY, None)
    facepoint_coord_path = sc.sticky.get(FACEPOINT_COORD_PATH_KEY, None)
    cell_facepoint_indexes_path = sc.sticky.get(CELL_FACEPOINT_INDEXES_PATH_KEY, None)

    if not hdf_path:
        raise ValueError("{} not found in sc.sticky.".format(HDF_PATH_KEY))

    if not facepoint_coord_path:
        raise ValueError("{} not found in sc.sticky.".format(FACEPOINT_COORD_PATH_KEY))

    if not cell_facepoint_indexes_path:
        raise ValueError("{} not found in sc.sticky.".format(CELL_FACEPOINT_INDEXES_PATH_KEY))

    return hdf_path, facepoint_coord_path, cell_facepoint_indexes_path


def read_facepoint_coords(hdf_path, facepoint_coord_path):
    with h5py.File(hdf_path, "r") as hdf_file:
        raw_coords = hdf_file[facepoint_coord_path][()]

    coords = []

    for row in raw_coords:
        if len(row) >= 3:
            coords.append((float(row[0]), float(row[1]), float(row[2])))
        else:
            coords.append((float(row[0]), float(row[1])))

    return coords


def read_cell_facepoint_indexes(hdf_path, cell_facepoint_indexes_path):
    with h5py.File(hdf_path, "r") as hdf_file:
        raw_indexes = hdf_file[cell_facepoint_indexes_path][()]

    cell_facepoint_indexes = []

    for row in raw_indexes:
        cell_facepoint_indexes.append([int(value) for value in row])

    return cell_facepoint_indexes


# -----------------------------
# Mesh helpers
# -----------------------------

def is_empty(value):
    if value is None:
        return True

    try:
        return len(value) == 0
    except:
        return False


def to_point3d(coord):
    if isinstance(coord, rg.Point3d):
        return coord

    if len(coord) == 2:
        return rg.Point3d(float(coord[0]), float(coord[1]), 0.0)

    if len(coord) >= 3:
        return rg.Point3d(float(coord[0]), float(coord[1]), float(coord[2]))

    raise ValueError("Invalid FacePoint coordinate: {}".format(coord))


def clean_cell_facepoint_row(row):
    """
    Remove only HEC-RAS padding values.

    Example:
        [0, 1, 2, 3, -1] -> [0, 1, 2, 3]
        [80, 13, 12, 79, 78] -> [80, 13, 12, 79, 78]
    """
    clean = []

    for value in row:
        index = int(value)

        # HEC-RAS padding / invalid index
        if index < 0:
            continue

        clean.append(index)

    return clean


def remove_repeated_closing_point(loop):
    """
    Remove repeated closing point if loop is explicitly closed.

    Example:
        [1, 2, 3, 1] -> [1, 2, 3]
    """
    if len(loop) > 1 and loop[0] == loop[-1]:
        return loop[:-1]

    return loop


def remove_consecutive_duplicate_points(loop):
    """
    Remove consecutive duplicate FacePoint IDs.

    Example:
        [1, 2, 2, 3] -> [1, 2, 3]
    """
    if not loop:
        return []

    clean = [loop[0]]

    for value in loop[1:]:
        if value != clean[-1]:
            clean.append(value)

    return clean


def validate_loop(loop, facepoint_count, cell_id):
    if len(loop) < 3:
        raise ValueError(
            "Cell {} has fewer than 3 valid FacePoints: {}".format(cell_id, loop)
        )

    unique_count = len(set(loop))
    if unique_count < 3:
        raise ValueError(
            "Cell {} has fewer than 3 unique FacePoints: {}".format(cell_id, loop)
        )

    for facepoint_id in loop:
        if facepoint_id < 0 or facepoint_id >= facepoint_count:
            raise ValueError(
                "Cell {} has FacePoint index {} out of range. Valid range: 0 to {}.".format(
                    cell_id,
                    facepoint_id,
                    facepoint_count - 1
                )
            )


def clean_and_validate_cell_loop(row, facepoint_count, cell_id):
    loop = clean_cell_facepoint_row(row)
    loop = remove_repeated_closing_point(loop)
    loop = remove_consecutive_duplicate_points(loop)
    loop = remove_repeated_closing_point(loop)

    validate_loop(loop, facepoint_count, cell_id)

    return loop


def collect_used_facepoint_indexes(cell_facepoint_indexes, facepoint_count):
    """
    Collect all FacePoint indexes actually used by valid cells.
    """
    used = set()

    for cell_id, row in enumerate(cell_facepoint_indexes):
        try:
            loop = clean_and_validate_cell_loop(
                row,
                facepoint_count,
                cell_id
            )

            for facepoint_id in loop:
                used.add(int(facepoint_id))

        except:
            # Ignore invalid cells here. They will be reported later.
            pass

    return sorted(list(used))


def build_vertex_maps(used_facepoint_indexes):
    """
    Build two maps:

    facepoint_to_mesh_vertex:
        original FacePoint index -> Rhino mesh vertex index

    mesh_vertex_to_facepoint:
        Rhino mesh vertex index -> original FacePoint index
    """
    facepoint_to_mesh_vertex = {}
    mesh_vertex_to_facepoint = []

    for mesh_vertex_id, facepoint_id in enumerate(used_facepoint_indexes):
        facepoint_to_mesh_vertex[facepoint_id] = mesh_vertex_id
        mesh_vertex_to_facepoint.append(facepoint_id)

    return facepoint_to_mesh_vertex, mesh_vertex_to_facepoint


def add_vertices_to_mesh(mesh, facepoint_coords, mesh_vertex_to_facepoint):
    """
    Add only used FacePoints as mesh vertices.

    This makes the mesh compact while preserving an explicit mapping.
    """
    for facepoint_id in mesh_vertex_to_facepoint:
        coord = facepoint_coords[facepoint_id]
        mesh.Vertices.Add(to_point3d(coord))


def convert_facepoint_loop_to_mesh_vertex_loop(loop, facepoint_to_mesh_vertex):
    """
    Convert original FacePoint IDs to Rhino mesh vertex IDs.
    """
    return [facepoint_to_mesh_vertex[int(facepoint_id)] for facepoint_id in loop]


def add_mesh_vertex_loop_to_mesh(mesh, mesh_vertex_loop):
    """
    Add one HEC-RAS cell to Rhino mesh.

    Rhino MeshFace supports:
        3 vertices -> triangle
        4 vertices -> quad

    For 5+ vertices:
        fan triangulation.

    Returns:
        added_face_count
        was_triangulated
    """
    n = len(mesh_vertex_loop)

    if n == 3:
        mesh.Faces.AddFace(
            int(mesh_vertex_loop[0]),
            int(mesh_vertex_loop[1]),
            int(mesh_vertex_loop[2])
        )
        return 1, False

    if n == 4:
        mesh.Faces.AddFace(
            int(mesh_vertex_loop[0]),
            int(mesh_vertex_loop[1]),
            int(mesh_vertex_loop[2]),
            int(mesh_vertex_loop[3])
        )
        return 1, False

    # 5+ polygon: fan triangulation.
    # HEC-RAS cell -> multiple Rhino MeshFaces.
    p0 = int(mesh_vertex_loop[0])
    triangle_count = 0

    for i in range(1, n - 1):
        p1 = int(mesh_vertex_loop[i])
        p2 = int(mesh_vertex_loop[i + 1])

        mesh.Faces.AddFace(p0, p1, p2)
        triangle_count += 1

    return triangle_count, True


def build_cell_mesh(facepoint_coords, cell_facepoint_indexes):
    """
    Build Rhino mesh from:
        FacePoint coordinates
        Cells FacePoint Indexes

    Important mapping:
        HEC-RAS Cell -> one or more Rhino MeshFaces

    Returns:
        mesh
        cell_point_loops
        mesh_vertex_to_facepoint
        mesh_face_to_hecras_cell
        raw_cell_count
        valid_cell_count
        mesh_face_count
        triangulated_cell_count
        skipped_cell_count
        skipped_cell_reports
    """
    if is_empty(facepoint_coords):
        raise ValueError("FacePoint coordinates are empty.")

    if is_empty(cell_facepoint_indexes):
        raise ValueError("Cells FacePoint Indexes are empty.")

    facepoint_count = len(facepoint_coords)
    raw_cell_count = len(cell_facepoint_indexes)

    # Step 1: collect used FacePoint IDs from valid cells
    used_facepoint_indexes = collect_used_facepoint_indexes(
        cell_facepoint_indexes,
        facepoint_count
    )

    if not used_facepoint_indexes:
        raise ValueError("No valid FacePoint indexes found in Cells FacePoint Indexes.")

    # Step 2: build explicit vertex mapping
    facepoint_to_mesh_vertex, mesh_vertex_to_facepoint = build_vertex_maps(
        used_facepoint_indexes
    )

    # Step 3: create mesh and add only used vertices
    mesh = rg.Mesh()

    add_vertices_to_mesh(
        mesh,
        facepoint_coords,
        mesh_vertex_to_facepoint
    )

    cell_point_loops = []

    # For every Rhino MeshFace, store the original HEC-RAS Cell index.
    # This is the main bridge for Water Surface / Depth coloring.
    mesh_face_to_hecras_cell = []

    triangulated_cell_count = 0
    skipped_cell_count = 0
    skipped_cell_reports = []

    # Step 4: add HEC-RAS cells as Rhino mesh faces
    for cell_id, row in enumerate(cell_facepoint_indexes):
        loop = []

        try:
            loop = clean_and_validate_cell_loop(
                row,
                facepoint_count,
                cell_id
            )

            mesh_vertex_loop = convert_facepoint_loop_to_mesh_vertex_loop(
                loop,
                facepoint_to_mesh_vertex
            )

            face_count_before = mesh.Faces.Count

            added_face_count, was_triangulated = add_mesh_vertex_loop_to_mesh(
                mesh,
                mesh_vertex_loop
            )

            face_count_after = mesh.Faces.Count

            actual_added_face_count = face_count_after - face_count_before

            if actual_added_face_count != added_face_count:
                raise ValueError(
                    "Expected to add {} Rhino faces, but actually added {}.".format(
                        added_face_count,
                        actual_added_face_count
                    )
                )

            # Add original HEC-RAS cell index once per newly added Rhino MeshFace.
            for mesh_face_id in range(face_count_before, face_count_after):
                mesh_face_to_hecras_cell.append(cell_id)

            if was_triangulated:
                triangulated_cell_count += 1

            # Keep original FacePoint IDs here, not mesh vertex IDs.
            cell_point_loops.append(loop)

        except Exception as error:
            skipped_cell_count += 1
            cell_point_loops.append([])

            skipped_cell_reports.append(
                "Cell {} skipped. Raw row: {}. Clean loop: {}. Error: {}".format(
                    cell_id,
                    row,
                    loop,
                    error
                )
            )

    mesh.Normals.ComputeNormals()
    mesh.Compact()

    valid_cell_count = len([loop for loop in cell_point_loops if loop])
    mesh_face_count = mesh.Faces.Count

    # Important validation:
    # Every Rhino MeshFace needs one HEC-RAS Cell index.
    if mesh_face_count != len(mesh_face_to_hecras_cell):
        raise ValueError(
            "Mesh face mapping mismatch. Mesh has {} faces, but HECRASCellIndexes has {} entries.".format(
                mesh_face_count,
                len(mesh_face_to_hecras_cell)
            )
        )

    return (
        mesh,
        cell_point_loops,
        mesh_vertex_to_facepoint,
        mesh_face_to_hecras_cell,
        raw_cell_count,
        valid_cell_count,
        mesh_face_count,
        triangulated_cell_count,
        skipped_cell_count,
        skipped_cell_reports
    )


# -----------------------------
# Default outputs
# -----------------------------

CellMesh = None
CellPointLoops = []
MeshVertexFacePointIndexes = []

# Rhino MeshFace index -> original HEC-RAS Cell index
HECRASCellIndexes = []

RawCellCount = 0
ValidCellCount = 0
MeshFaceCount = 0
TriangulatedCellCount = 0
SkippedCellCount = 0
SkippedCellReports = []

Status = "Idle: press Run to build cell mesh."


# -----------------------------
# Grasshopper execution
# -----------------------------

try:
    if not Run:
        CellMesh = sc.sticky.get(HECRAS_CELL_MESH_KEY, None)
        CellPointLoops = sc.sticky.get(HECRAS_CELL_POINT_LOOPS_KEY, [])
        MeshVertexFacePointIndexes = sc.sticky.get(
            HECRAS_MESH_VERTEX_FACEPOINT_INDEXES_KEY,
            []
        )
        HECRASCellIndexes = sc.sticky.get(
            HECRAS_MESH_FACE_CELL_INDEXES_KEY,
            []
        )

        RawCellCount = sc.sticky.get(HECRAS_RAW_CELL_COUNT_KEY, 0)
        ValidCellCount = sc.sticky.get(HECRAS_VALID_CELL_COUNT_KEY, 0)
        MeshFaceCount = sc.sticky.get(HECRAS_MESH_FACE_COUNT_KEY, 0)
        TriangulatedCellCount = sc.sticky.get(HECRAS_TRIANGULATED_CELL_COUNT_KEY, 0)
        SkippedCellCount = sc.sticky.get(HECRAS_SKIPPED_CELL_COUNT_KEY, 0)
        SkippedCellReports = sc.sticky.get(HECRAS_SKIPPED_CELL_REPORTS_KEY, [])

        if CellMesh:
            Status = (
                "Cached: cell mesh available. "
                "Raw HEC-RAS cells: {}. Valid cells: {}. Rhino mesh faces: {}. "
                "HECRASCellIndexes: {}. Triangulated cells: {}. Skipped cells: {}. "
                "Press Run to rebuild."
            ).format(
                RawCellCount,
                ValidCellCount,
                MeshFaceCount,
                len(HECRASCellIndexes),
                TriangulatedCellCount,
                SkippedCellCount
            )
        else:
            Status = "Idle: press Run to build cell mesh."

    else:
        hdf_path, facepoint_coord_path, cell_facepoint_indexes_path = read_paths_from_sticky()

        facepoint_coords = read_facepoint_coords(
            hdf_path,
            facepoint_coord_path
        )

        cell_facepoint_indexes = read_cell_facepoint_indexes(
            hdf_path,
            cell_facepoint_indexes_path
        )

        (
            cell_mesh,
            cell_point_loops,
            mesh_vertex_to_facepoint,
            mesh_face_to_hecras_cell,
            raw_cell_count,
            valid_cell_count,
            mesh_face_count,
            triangulated_cell_count,
            skipped_cell_count,
            skipped_cell_reports
        ) = build_cell_mesh(
            facepoint_coords,
            cell_facepoint_indexes
        )

        # Cache outputs
        sc.sticky[HECRAS_CELL_MESH_KEY] = cell_mesh
        sc.sticky[HECRAS_CELL_POINT_LOOPS_KEY] = cell_point_loops
        sc.sticky[HECRAS_MESH_VERTEX_FACEPOINT_INDEXES_KEY] = mesh_vertex_to_facepoint
        sc.sticky[HECRAS_MESH_FACE_CELL_INDEXES_KEY] = mesh_face_to_hecras_cell

        sc.sticky[HECRAS_RAW_CELL_COUNT_KEY] = raw_cell_count
        sc.sticky[HECRAS_VALID_CELL_COUNT_KEY] = valid_cell_count
        sc.sticky[HECRAS_MESH_FACE_COUNT_KEY] = mesh_face_count
        sc.sticky[HECRAS_TRIANGULATED_CELL_COUNT_KEY] = triangulated_cell_count
        sc.sticky[HECRAS_SKIPPED_CELL_COUNT_KEY] = skipped_cell_count
        sc.sticky[HECRAS_SKIPPED_CELL_REPORTS_KEY] = skipped_cell_reports

        # Set GH outputs
        CellMesh = cell_mesh
        CellPointLoops = cell_point_loops
        MeshVertexFacePointIndexes = mesh_vertex_to_facepoint
        HECRASCellIndexes = mesh_face_to_hecras_cell

        RawCellCount = raw_cell_count
        ValidCellCount = valid_cell_count
        MeshFaceCount = mesh_face_count
        TriangulatedCellCount = triangulated_cell_count
        SkippedCellCount = skipped_cell_count
        SkippedCellReports = skipped_cell_reports

        Status = (
            "Success: read {} raw HEC-RAS cells; built {} valid cells into {} Rhino mesh faces. "
            "{} mesh vertices mapped to original FacePoint indexes. "
            "{} HECRASCellIndexes generated. "
            "{} cells triangulated. {} cells skipped."
        ).format(
            RawCellCount,
            ValidCellCount,
            MeshFaceCount,
            len(MeshVertexFacePointIndexes),
            len(HECRASCellIndexes),
            TriangulatedCellCount,
            SkippedCellCount
        )

except Exception as error:
    CellMesh = None
    CellPointLoops = []
    MeshVertexFacePointIndexes = []
    HECRASCellIndexes = []

    RawCellCount = 0
    ValidCellCount = 0
    MeshFaceCount = 0
    TriangulatedCellCount = 0
    SkippedCellCount = 0
    SkippedCellReports = []

    Status = "Failed: {}".format(error)
# ---------- end py3_4 ----------
mesh_3 = Mesh(py3_4.CellMesh)
panel_19 = Panel(py3_4.Status)

# ----
# 6 HDF5 - Dataset Reading...
# HDF5 - Results Reader
hecras_reader_3 = Python3Script(ResultPath=item, QueryTimeIndex=number_slider, LiveUpdate=toggle, Run=button)  # -> Values, DatasetUnit, SelectedTimeIndex, SelectedTimestamp, Status
# ---------- hecras_reader_3: Python ----------
# requirements: h5py
import h5py
import scriptcontext as sc
import os


# -----------------------------
# Sticky keys / global constants
# -----------------------------

HDF_PATH_KEY = "HDF_PATH"
TIME_DATE_STAMP_PATH_KEY = "TIME_DATE_STAMP_PATH"

# Generic cache keys
HECRAS_RESULT_VALUES_KEY = "HECRAS_RESULT_VALUES"
HECRAS_RESULT_VALUE_COUNT_KEY = "HECRAS_RESULT_VALUE_COUNT"
HECRAS_RESULT_PATH_KEY = "HECRAS_RESULT_PATH"
HECRAS_RESULT_NAME_KEY = "HECRAS_RESULT_NAME"
HECRAS_RESULT_DATASET_SHAPE_KEY = "HECRAS_RESULT_DATASET_SHAPE"
HECRAS_RESULT_DATASET_UNIT_KEY = "HECRAS_RESULT_DATASET_UNIT"

HECRAS_SELECTED_TIME_INDEX_KEY = "HECRAS_SELECTED_TIME_INDEX"
HECRAS_SELECTED_TIMESTAMP_KEY = "HECRAS_SELECTED_TIMESTAMP"


# -----------------------------
# Helpers
# -----------------------------

def decode_hdf5_string(value):
    if isinstance(value, bytes):
        return value.decode("utf-8", errors="replace")
    return str(value)


def decode_hdf5_attr(value):
    """
    Convert HDF5 attribute value to a clean string.
    Handles bytes, strings, and small arrays/lists.
    """
    if isinstance(value, bytes):
        return value.decode("utf-8", errors="replace")

    try:
        if hasattr(value, "__iter__") and not isinstance(value, str):
            decoded = []
            for item in value:
                decoded.append(decode_hdf5_attr(item))
            return ", ".join(decoded)
    except:
        pass

    return str(value)


def is_empty(value):
    if value is None:
        return True
    if isinstance(value, str) and value.strip() == "":
        return True
    return False


def as_bool(value):
    """
    Grasshopper-safe bool conversion.
    """
    if value is None:
        return False
    return bool(value)


def normalize_timestamp(value):
    return decode_hdf5_string(value).strip()


def normalize_hdf5_path(path):
    """
    Grasshopper-safe path cleanup.
    Allows paths with or without leading slash.
    """
    if is_empty(path):
        return ""

    clean_path = str(path).strip()

    # h5py accepts both, but keeping no leading slash is cleaner
    while clean_path.startswith("/"):
        clean_path = clean_path[1:]

    return clean_path


def get_result_name(result_path):
    """
    Get readable result name from HDF5 path.
    Example:
        .../Water Surface -> Water Surface
        .../Face Shear Stress -> Face Shear Stress
    """
    clean_path = normalize_hdf5_path(result_path)

    if not clean_path:
        return ""

    return clean_path.split("/")[-1]


def get_dataset_unit(hdf_path, result_path):
    """
    Read the Units attribute from a result dataset.
    Returns empty string if no Units attribute exists.
    """
    result_path = normalize_hdf5_path(result_path)

    with h5py.File(hdf_path, "r") as hdf_file:
        if result_path not in hdf_file:
            raise ValueError("ResultPath not found in HDF5: {}".format(result_path))

        dataset = hdf_file[result_path]

        if "Units" not in dataset.attrs:
            return ""

        return decode_hdf5_attr(dataset.attrs["Units"])


def read_all_timestamps(hdf_path, timestamp_path):
    if not timestamp_path:
        return []

    timestamp_path = normalize_hdf5_path(timestamp_path)

    with h5py.File(hdf_path, "r") as hdf_file:
        raw_timestamps = hdf_file[timestamp_path][()]

    return [normalize_timestamp(t) for t in raw_timestamps]


def get_dataset_shape(hdf_path, result_path):
    """
    Check result dataset shape.
    Expected for time-varying 2D result:
        (time_count, value_count)

    Examples:
        Water Surface:
            (time_count, cell_count)

        Face Shear Stress:
            (time_count, face_count)
    """
    result_path = normalize_hdf5_path(result_path)

    with h5py.File(hdf_path, "r") as hdf_file:
        if result_path not in hdf_file:
            raise ValueError("ResultPath not found in HDF5: {}".format(result_path))

        dataset_shape = hdf_file[result_path].shape

    if len(dataset_shape) != 2:
        raise ValueError(
            "Expected result dataset shape (time, values), got {} for path '{}'.".format(
                dataset_shape,
                result_path
            )
        )

    return dataset_shape


def get_time_count(hdf_path, result_path):
    dataset_shape = get_dataset_shape(hdf_path, result_path)
    return dataset_shape[0]


def read_selected_result_values(hdf_path, result_path, time_index):
    """
    Read one timestep from a generic HDF5 result dataset.
    Returns one list of values.

    Expected shape:
        (time_count, value_count)
    """
    result_path = normalize_hdf5_path(result_path)

    with h5py.File(hdf_path, "r") as hdf_file:
        if result_path not in hdf_file:
            raise ValueError("ResultPath not found in HDF5: {}".format(result_path))

        dataset = hdf_file[result_path]
        dataset_shape = dataset.shape

        if len(dataset_shape) != 2:
            raise ValueError(
                "Expected result dataset shape (time, values), got {} for path '{}'.".format(
                    dataset_shape,
                    result_path
                )
            )

        time_count = dataset_shape[0]

        if time_index < 0 or time_index >= time_count:
            raise ValueError(
                "QueryTimeIndex {} out of range. Valid range: 0 to {}.".format(
                    time_index,
                    time_count - 1
                )
            )

        raw_values = dataset[time_index, :]

    return [float(value) for value in raw_values]


def resolve_time_query(query_time_index, query_time_stamp, timestamps, time_count):
    has_index = not is_empty(query_time_index)
    has_stamp = not is_empty(query_time_stamp)

    if not has_index and not has_stamp:
        return None, None, "Idle: provide QueryTimeIndex or QueryTimeStamp."

    selected_index_from_index = None
    selected_index_from_stamp = None

    # Resolve from QueryTimeIndex
    if has_index:
        try:
            selected_index_from_index = int(query_time_index)
        except:
            raise ValueError("QueryTimeIndex must be an integer.")

        if selected_index_from_index < 0 or selected_index_from_index >= time_count:
            raise ValueError(
                "QueryTimeIndex {} out of range. Valid range: 0 to {}.".format(
                    selected_index_from_index,
                    time_count - 1
                )
            )

    # Resolve from QueryTimeStamp
    if has_stamp:
        if not timestamps:
            raise ValueError(
                "QueryTimeStamp was provided, but timestamps are not available. Check TIME_DATE_STAMP_PATH."
            )

        target_stamp = normalize_timestamp(query_time_stamp)

        if target_stamp not in timestamps:
            raise ValueError(
                "QueryTimeStamp not found: '{}'. Disable QueryTimeStamp or choose a valid timestamp.".format(
                    target_stamp
                )
            )

        selected_index_from_stamp = timestamps.index(target_stamp)

    # If both are provided, they must align
    if has_index and has_stamp:
        if selected_index_from_index != selected_index_from_stamp:
            index_stamp = timestamps[selected_index_from_index] if timestamps else ""

            raise ValueError(
                "QueryTimeIndex and QueryTimeStamp are not aligned. "
                "QueryTimeIndex {} corresponds to '{}', but QueryTimeStamp corresponds to TimeIndex {}. "
                "Please align them or disable one query input.".format(
                    selected_index_from_index,
                    index_stamp,
                    selected_index_from_stamp
                )
            )

        selected_index = selected_index_from_index
        selected_stamp = timestamps[selected_index] if timestamps else ""
        return selected_index, selected_stamp, "Resolved: QueryTimeIndex and QueryTimeStamp are aligned."

    # Only QueryTimeIndex provided
    if has_index:
        selected_index = selected_index_from_index
        selected_stamp = timestamps[selected_index] if timestamps else ""
        return selected_index, selected_stamp, "Resolved: selected timestep from QueryTimeIndex."

    # Only QueryTimeStamp provided
    selected_index = selected_index_from_stamp
    selected_stamp = timestamps[selected_index]
    return selected_index, selected_stamp, "Resolved: selected timestep from QueryTimeStamp."


# -----------------------------
# Default outputs
# -----------------------------

Values = []
ValueCount = 0
SelectedTimeIndex = None
SelectedTimestamp = None
ResultName = ""
DatasetShape = None
DatasetUnit = ""
Status = "Idle: provide ResultPath and QueryTimeIndex or QueryTimeStamp."


# -----------------------------
# Grasshopper execution
# -----------------------------

try:
    hdf_path = sc.sticky.get(HDF_PATH_KEY)
    timestamp_path = sc.sticky.get(TIME_DATE_STAMP_PATH_KEY)

    run_update = as_bool(Run)
    live_update = as_bool(LiveUpdate)
    should_update = run_update or live_update

    if not hdf_path:
        raise ValueError("{} not found in sc.sticky.".format(HDF_PATH_KEY))

    if is_empty(ResultPath):
        raise ValueError("ResultPath input is empty.")

    result_path = normalize_hdf5_path(ResultPath)
    result_name = get_result_name(result_path)

    dataset_shape = get_dataset_shape(hdf_path, result_path)
    time_count = dataset_shape[0]
    values_per_timestep = dataset_shape[1]

    dataset_unit = get_dataset_unit(hdf_path, result_path)

    timestamps = read_all_timestamps(hdf_path, timestamp_path)

    selected_time_index, selected_timestamp, resolve_status = resolve_time_query(
        QueryTimeIndex,
        QueryTimeStamp,
        timestamps,
        time_count
    )

    # If neither query is provided
    if selected_time_index is None:
        Values = sc.sticky.get(HECRAS_RESULT_VALUES_KEY, [])
        ValueCount = len(Values)
        SelectedTimeIndex = sc.sticky.get(HECRAS_SELECTED_TIME_INDEX_KEY, None)
        SelectedTimestamp = sc.sticky.get(HECRAS_SELECTED_TIMESTAMP_KEY, None)
        ResultName = result_name
        DatasetShape = dataset_shape
        DatasetUnit = dataset_unit

        Status = "{} Result '{}', shape {}, unit '{}'.".format(
            resolve_status,
            result_name,
            dataset_shape,
            dataset_unit
        )

    # Query is valid, but neither Run nor LiveUpdate is active
    elif not should_update:
        cached_path = sc.sticky.get(HECRAS_RESULT_PATH_KEY, "")
        cached_values = sc.sticky.get(HECRAS_RESULT_VALUES_KEY, [])

        Values = cached_values
        ValueCount = len(cached_values)

        SelectedTimeIndex = sc.sticky.get(
            HECRAS_SELECTED_TIME_INDEX_KEY,
            selected_time_index
        )
        SelectedTimestamp = sc.sticky.get(
            HECRAS_SELECTED_TIMESTAMP_KEY,
            selected_timestamp
        )

        ResultName = result_name
        DatasetShape = dataset_shape
        DatasetUnit = dataset_unit

        if cached_values and cached_path == result_path:
            Status = (
                "{} Cached: {} values available for result '{}'. "
                "Unit '{}'. "
                "Turn on LiveUpdate or press Run to update to TimeIndex {}, Timestamp '{}'."
            ).format(
                resolve_status,
                len(cached_values),
                result_name,
                dataset_unit,
                selected_time_index,
                selected_timestamp
            )

        elif cached_values and cached_path != result_path:
            Status = (
                "{} Warning: cached values are from a different ResultPath. "
                "Current ResultPath is '{}'. Cached ResultPath is '{}'. "
                "Turn on LiveUpdate or press Run to read the current result."
            ).format(
                resolve_status,
                result_path,
                cached_path
            )

        else:
            Status = (
                "{} Ready: result '{}' found with shape {} and unit '{}'. "
                "Turn on LiveUpdate or press Run to read values."
            ).format(
                resolve_status,
                result_name,
                dataset_shape,
                dataset_unit
            )

    # Query is valid and Run or LiveUpdate is active
    else:
        values = read_selected_result_values(
            hdf_path,
            result_path,
            selected_time_index
        )

        sc.sticky[HECRAS_RESULT_VALUES_KEY] = values
        sc.sticky[HECRAS_RESULT_VALUE_COUNT_KEY] = len(values)
        sc.sticky[HECRAS_RESULT_PATH_KEY] = result_path
        sc.sticky[HECRAS_RESULT_NAME_KEY] = result_name
        sc.sticky[HECRAS_RESULT_DATASET_SHAPE_KEY] = dataset_shape
        sc.sticky[HECRAS_RESULT_DATASET_UNIT_KEY] = dataset_unit

        sc.sticky[HECRAS_SELECTED_TIME_INDEX_KEY] = selected_time_index
        sc.sticky[HECRAS_SELECTED_TIMESTAMP_KEY] = selected_timestamp

        Values = values
        ValueCount = len(values)
        SelectedTimeIndex = selected_time_index
        SelectedTimestamp = selected_timestamp
        ResultName = result_name
        DatasetShape = dataset_shape
        DatasetUnit = dataset_unit

        update_mode = "LiveUpdate" if live_update and not run_update else "Run"

        Status = (
            "Success [{}]: loaded {} values from result '{}' at TimeIndex {}, Timestamp '{}'. "
            "Dataset shape: {}. Unit: '{}'."
        ).format(
            update_mode,
            len(values),
            result_name,
            selected_time_index,
            selected_timestamp,
            dataset_shape,
            dataset_unit
        )

except Exception as error:
    Values = []
    ValueCount = 0
    SelectedTimeIndex = None
    SelectedTimestamp = None
    ResultName = ""
    DatasetShape = None
    DatasetUnit = ""
    Status = "Failed: {}".format(error)
# ---------- end hecras_reader_3 ----------
panel_20 = Panel(hecras_reader_3.SelectedTimestamp)
panel_21 = Panel(hecras_reader_3.Status)
panel_22 = Panel(hecras_reader_3.SelectedTimeIndex)
panel_23 = Panel(hecras_reader_3.Values)

panel_24 = Panel(hecras_reader_3.DatasetUnit)

# ----
# HDF5 - Results - Face Values to Cell Vectors Interpolator
py3_5 = Python3Script(FaceValues=hecras_reader_3.Values, LiveUpdate=toggle, Run=button)  # -> out, CellValues, HECRASCellIndexes, Status; inputs FaceValues: list of Double
# ---------- py3_5: Python ----------
# -*- coding: utf-8 -*-
"""
GhPython Component B
Convert HEC-RAS face-normal scalar values to cell-centered vectors.

Inputs:
    FaceValues: List Access, float
    LiveUpdate: bool
    Run: bool/button

Outputs:
    CellValues: list of (vx, vy)
    HECRASCellIndexes: list of local HEC-RAS cell indexes, 0-based
    Status: str

This follows the core MDAL readFaceOutput() logic:
    - For each HEC-RAS cell:
        - Get its surrounding HEC-RAS face indexes.
        - For each adjacent face pair:
            - Read two face-normal scalar values.
            - Compute normals from face endpoint coordinates.
            - Solve a 2x2 system for vx, vy.
        - Average all usable pair solutions.

Important:
    Component A should already have stored this sticky key:
        HECRAS_FACE_VECTOR_SOURCE_v1

    Expected sticky content:
        {
            "hdf_path": "...",
            "flow_area": "..."
        }
"""

import math
import os
import scriptcontext as sc


# -----------------------------
# Sticky keys / global constants
# -----------------------------

# STICKY_KEY = "HECRAS_FACE_VECTOR_SOURCE_v1"

HECRAS_CELL_VECTOR_VALUES_KEY = "HECRAS_CELL_VECTOR_VALUES"
HECRAS_CELL_VECTOR_INDEXES_KEY = "HECRAS_CELL_VECTOR_INDEXES"
HECRAS_CELL_VECTOR_FLOW_AREA_KEY = "HECRAS_CELL_VECTOR_FLOW_AREA"
HECRAS_CELL_VECTOR_FACE_COUNT_KEY = "HECRAS_CELL_VECTOR_FACE_COUNT"
HECRAS_CELL_VECTOR_STATUS_KEY = "HECRAS_CELL_VECTOR_STATUS"

NAN = float("nan")
EPS = 1e-12


# -----------------------------
# Helpers
# -----------------------------

def import_h5py():
    try:
        import h5py
        return h5py, None
    except Exception as e:
        return None, (
            "Cannot import h5py. Use Rhino 8 CPython/Python component with h5py "
            "available, or pre-extract topology outside Rhino. Error: {}"
        ).format(e)


def as_bool(value):
    """
    Grasshopper-safe bool conversion.
    """
    if value is None:
        return False
    return bool(value)


def coerce_float(x):
    """
    Convert GH inputs / GH_Number / strings to float.
    Invalid values become NaN.
    """
    if x is None:
        return NAN

    try:
        if hasattr(x, "Value"):
            x = x.Value
    except:
        pass

    try:
        return float(x)
    except:
        try:
            s = str(x).strip()
            if not s:
                return NAN
            return float(s)
        except:
            return NAN


def normalize_face_values(values):
    """
    Normalize FaceValues input into a flat list of floats.
    """
    if values is None:
        return []

    try:
        return [coerce_float(v) for v in values]
    except:
        return [coerce_float(values)]


def is_nan(v):
    try:
        return math.isnan(v)
    except:
        return False


def get2(arr, i, j):
    """
    Access 2D numpy arrays, nested lists, or flattened 2-column arrays.
    """
    try:
        return arr[i, j]
    except:
        pass

    try:
        return arr[i][j]
    except:
        pass

    return arr[i * 2 + j]


def get_xy(coords, idx):
    """
    Read x,y from FacePoints Coordinate.
    HEC-RAS usually stores shape (nPoints, 2).
    """
    x = float(get2(coords, idx, 0))
    y = float(get2(coords, idx, 1))
    return x, y


def reconstruct_cell_vectors(face_values, cell_face_info, cell_face_or_values,
                             face_point_index, coords):
    """
    Reconstruct one cell-centered vector from surrounding HEC-RAS face-normal scalar values.
    """
    n_cells = int(cell_face_info.shape[0])
    n_faces = int(face_point_index.shape[0])
    n_points = int(coords.shape[0])

    cell_values = []
    cell_indexes = []

    stats = {
        "valid_cells": 0,
        "invalid_cells": 0,
        "nan_pairs": 0,
        "bad_face_index_pairs": 0,
        "bad_point_index_pairs": 0,
        "non_common_vertex_pairs": 0,
        "zero_length_pairs": 0,
        "parallel_pairs": 0,
        "used_pairs": 0
    }

    for cell_idx in range(n_cells):
        valx = 0.0
        valy = 0.0
        considered = 0

        first_position = int(get2(cell_face_info, cell_idx, 0))
        face_count = int(get2(cell_face_info, cell_idx, 1))

        if face_count < 2:
            cell_values.append((NAN, NAN))
            cell_indexes.append(cell_idx)
            stats["invalid_cells"] += 1
            continue

        for f in range(face_count):
            row1 = first_position + f
            row2 = first_position + ((f + 1) % face_count)

            # HEC-RAS / MDAL:
            # column 0 = face index
            # column 1 = orientation info
            # MDAL's vector reconstruction mainly uses face index here.
            face_index_1 = int(get2(cell_face_or_values, row1, 0))
            face_index_2 = int(get2(cell_face_or_values, row2, 0))

            if (
                face_index_1 < 0 or face_index_1 >= n_faces or
                face_index_2 < 0 or face_index_2 >= n_faces or
                face_index_1 >= len(face_values) or
                face_index_2 >= len(face_values)
            ):
                stats["bad_face_index_pairs"] += 1
                continue

            val1 = face_values[face_index_1]
            val2 = face_values[face_index_2]

            if is_nan(val1) or is_nan(val2):
                stats["nan_pairs"] += 1
                continue

            p11 = int(get2(face_point_index, face_index_1, 0))
            p12 = int(get2(face_point_index, face_index_1, 1))
            p21 = int(get2(face_point_index, face_index_2, 0))
            p22 = int(get2(face_point_index, face_index_2, 1))

            if (
                p11 < 0 or p11 >= n_points or
                p12 < 0 or p12 >= n_points or
                p21 < 0 or p21 >= n_points or
                p22 < 0 or p22 >= n_points
            ):
                stats["bad_point_index_pairs"] += 1
                continue

            common_index = (
                p11 == p21 or p11 == p22 or
                p12 == p21 or p12 == p22
            )

            if not common_index:
                stats["non_common_vertex_pairs"] += 1
                continue

            x11, y11 = get_xy(coords, p11)
            x12, y12 = get_xy(coords, p12)
            x21, y21 = get_xy(coords, p21)
            x22, y22 = get_xy(coords, p22)

            # Same direction convention as MDAL:
            # dx = point1 - point2
            # normal = (-dy / length, dx / length)
            dx1 = x11 - x12
            dy1 = y11 - y12
            dx2 = x21 - x22
            dy2 = y21 - y22

            l1 = math.sqrt(dx1 * dx1 + dy1 * dy1)
            l2 = math.sqrt(dx2 * dx2 + dy2 * dy2)

            if l1 <= EPS or l2 <= EPS:
                stats["zero_length_pairs"] += 1
                continue

            nx1 = -dy1 / l1
            ny1 = dx1 / l1
            nx2 = -dy2 / l2
            ny2 = dx2 / l2

            determinant = nx1 * ny2 - nx2 * ny1

            if abs(determinant) <= EPS:
                stats["parallel_pairs"] += 1
                continue

            # Solve:
            #
            #   nx1 * vx + ny1 * vy = val1
            #   nx2 * vx + ny2 * vy = val2
            #
            # Algebra:
            #
            #   vx = (ny2 * val1 - ny1 * val2) / determinant
            #   vy = (nx1 * val2 - nx2 * val1) / determinant

            vx_pair = (ny2 * val1 - ny1 * val2) / determinant
            vy_pair = (nx1 * val2 - nx2 * val1) / determinant

            valx += vx_pair
            valy += vy_pair
            considered += 1
            stats["used_pairs"] += 1

        if considered > 0:
            valx /= float(considered)
            valy /= float(considered)
            cell_values.append((valx, valy))
            stats["valid_cells"] += 1
        else:
            cell_values.append((NAN, NAN))
            stats["invalid_cells"] += 1

        cell_indexes.append(cell_idx)

    return cell_values, cell_indexes, stats


# -----------------------------
# Default outputs
# -----------------------------

CellValues = sc.sticky.get(HECRAS_CELL_VECTOR_VALUES_KEY, [])
HECRASCellIndexes = sc.sticky.get(HECRAS_CELL_VECTOR_INDEXES_KEY, [])
Status = "Idle: press Run or enable LiveUpdate to reconstruct cell vectors."


# -----------------------------
# Grasshopper execution
# -----------------------------

try:
    run_update = as_bool(Run)
    live_update = as_bool(LiveUpdate)
    should_update = run_update or live_update

    # state = sc.sticky.get(STICKY_KEY, None)

    # if not state:
    #     raise ValueError("No HEC-RAS source found in sticky. Run Component A first.")

    hdf_path = sc.sticky.get("HDF_PATH","")
    flow_area = "2D_Domain"
    if not hdf_path or not os.path.isfile(hdf_path):
        raise ValueError("HDF path from sticky is invalid: {}".format(hdf_path))

    if not flow_area:
        raise ValueError("Flow area from sticky is empty. Run Component A again.")

    # Query/source is valid, but neither Run nor LiveUpdate is active.
    # Keep cached output instead of clearing it.
    if not should_update:
        cached_values = sc.sticky.get(HECRAS_CELL_VECTOR_VALUES_KEY, [])
        cached_indexes = sc.sticky.get(HECRAS_CELL_VECTOR_INDEXES_KEY, [])
        cached_area = sc.sticky.get(HECRAS_CELL_VECTOR_FLOW_AREA_KEY, "")
        cached_face_count = sc.sticky.get(HECRAS_CELL_VECTOR_FACE_COUNT_KEY, None)

        CellValues = cached_values
        HECRASCellIndexes = cached_indexes

        if cached_values and cached_area == flow_area:
            Status = (
                "Cached: {} cell vectors available for FlowArea '{}'. "
                "FaceCount={}. Turn on LiveUpdate or press Run to update."
            ).format(
                len(cached_values),
                flow_area,
                cached_face_count
            )

        elif cached_values and cached_area != flow_area:
            Status = (
                "Warning: cached vectors are from a different FlowArea. "
                "Current FlowArea is '{}'. Cached FlowArea is '{}'. "
                "Press Run to update."
            ).format(
                flow_area,
                cached_area
            )

        else:
            Status = (
                "Ready: source is set for FlowArea '{}'. "
                "Press Run or enable LiveUpdate to reconstruct cell vectors."
            ).format(flow_area)

    # Run or LiveUpdate is active: compute and cache.
    else:
        h5py, import_error = import_h5py()

        if import_error:
            raise ValueError(import_error)

        face_values = normalize_face_values(FaceValues)

        with h5py.File(hdf_path, "r") as f:
            area_path = "/Geometry/2D Flow Areas/{}".format(flow_area)

            if area_path not in f:
                raise ValueError("Missing HDF group: {}".format(area_path))

            g_area = f[area_path]

            cell_face_info = g_area["Cells Face and Orientation Info"][()]
            cell_face_or_values = g_area["Cells Face and Orientation Values"][()]
            face_point_index = g_area["Faces FacePoint Indexes"][()]
            coords = g_area["FacePoints Coordinate"][()]

        n_faces = int(face_point_index.shape[0])

        warning = ""

        if len(face_values) < n_faces:
            raise ValueError(
                "FaceValues length is too short. Got {}, expected at least nFaces={}. "
                "Pass one timestep of HEC-RAS Face Velocity values."
                .format(len(face_values), n_faces)
            )

        if len(face_values) > n_faces:
            if len(face_values) % n_faces == 0:
                warning = (
                    "Warning: FaceValues length {} is a multiple of nFaces {}; "
                    "this looks like multiple timesteps flattened together. "
                    "Using the first {} values only. "
                ).format(len(face_values), n_faces, n_faces)
            else:
                warning = (
                    "Warning: FaceValues length {} > nFaces {}; "
                    "using the first {} values only. "
                ).format(len(face_values), n_faces, n_faces)

            face_values = face_values[:n_faces]

        cell_values, cell_indexes, stats = reconstruct_cell_vectors(
            face_values,
            cell_face_info,
            cell_face_or_values,
            face_point_index,
            coords
        )

        # Cache result using the same simple sticky pattern as your other scripts.
        sc.sticky[HECRAS_CELL_VECTOR_VALUES_KEY] = cell_values
        sc.sticky[HECRAS_CELL_VECTOR_INDEXES_KEY] = cell_indexes
        sc.sticky[HECRAS_CELL_VECTOR_FLOW_AREA_KEY] = flow_area
        sc.sticky[HECRAS_CELL_VECTOR_FACE_COUNT_KEY] = n_faces

        CellValues = cell_values
        HECRASCellIndexes = cell_indexes

        update_mode = "LiveUpdate" if live_update and not run_update else "Run"

        Status = (
            "{}Success [{}]: reconstructed {}/{} cell vectors for FlowArea '{}'. "
            "nFaces={}. Used face-pairs={}. Invalid cells={}. "
            "Skipped pairs: nan={}, bad_face_index={}, bad_point_index={}, "
            "non_common_vertex={}, zero_length={}, parallel={}."
        ).format(
            warning,
            update_mode,
            stats["valid_cells"],
            len(CellValues),
            flow_area,
            n_faces,
            stats["used_pairs"],
            stats["invalid_cells"],
            stats["nan_pairs"],
            stats["bad_face_index_pairs"],
            stats["bad_point_index_pairs"],
            stats["non_common_vertex_pairs"],
            stats["zero_length_pairs"],
            stats["parallel_pairs"]
        )

        sc.sticky[HECRAS_CELL_VECTOR_STATUS_KEY] = Status

except Exception as error:
    # Match your existing style:
    # hard failure clears output.
    CellValues = []
    HECRASCellIndexes = []
    Status = "Failed: {}".format(error)
# ---------- end py3_5 ----------
panel_25 = Panel(py3_5.CellValues)
panel_26 = Panel(py3_5.Status)
py3_6 = Python3Script(VectorTuples=py3_5.CellValues)  # -> out, Values, Vx, Vy; inputs VectorTuples: list
# ---------- py3_6: Python ----------
import math

Values = []
Vx = []
Vy = []

for item in VectorTuples:

    try:
        x, y = item
        x = float(x)
        y = float(y)

        if math.isnan(x) or math.isnan(y):
            raise ValueError

        Vx.append(x)
        Vy.append(y)
        Values.append((x**2 + y**2)**0.5)

    except:
        Vx.append(None)
        Vy.append(None)
        Values.append(None)
# ---------- end py3_6 ----------

filter = StreamFilter(Gate=py3_3.a, Stream0=py3_6.Values, Stream1=hecras_reader_3.Values)

# ---- group: Gradient
dedomain = DeconstructDomain(Domain=panel_15)  # -> Start, End

# ----
panel_27 = Panel("G:\My Drive\06_Publication_Pre\Acadia2025\02_3D\03_ZValue_To_VelocityMesh\velocity_stablized\velocity.asc")  # disabled
pipeline = GeometryPipeline(
    GroupByLayer=False,
    GroupByType=False,
    IncludeHidden=True,
    IncludeLocked=True,
    LayerFilter="0_Base_VelocityMesh*",
    NameFilter="*",
    SublayerFiltering=True,
    TypeFilter=32)  # disabled
panel_28 = Panel("2")  # disabled
import = TerrainImport(ASCFile=panel_27, StepSize=panel_28, ColorLow=0, ColorHigh=0)  # disabled
mesh_4 = Mesh(import)  # disabled
demesh_2 = DeconstructMesh(Mesh=mesh_4)  # -> Vertices, Faces, Colours, Normals; disabled
pdecon = Deconstruct(Point=demesh_2.Vertices)  # -> XComponent, YComponent, ZComponent; disabled
panel_29 = Panel("0")  # disabled
smaller = SmallerThan(FirstNumber=pdecon.ZComponent, SecondNumber=panel_29)  # -> SmallerThan, OrEqualTo; disabled
cullv = CullVertices(Mesh=mesh_4, Pattern=smaller.SmallerThan, Shrink=True)  # disabled
mesh_5 = Mesh(cullv)  # disabled
demesh_3 = DeconstructMesh(Mesh=mesh_5)  # -> Vertices, Faces, Colours, Normals; disabled
pdecon_2 = Deconstruct(Point=demesh_3.Vertices)  # -> XComponent, YComponent, ZComponent; disabled
py3_7 = Python3Script(x=pdecon_2.ZComponent)  # -> out, a; disabled
# ---------- py3_7: Python ----------
"""Grasshopper Script"""
import math

if x > 0:
    a = math.log2(x)
else:
    a = None  # Handle negative numbers or zero
# ---------- end py3_7 ----------
graph = QuickGraph(pdecon_2.ZComponent, SortOrder=0)  # disabled
panel_30 = Panel("1")  # disabled
division_3 = Division(A=py3_7.a, B=panel_30)  # disabled
round = Round(Number=division_3)  # -> Nearest, Floor, Ceiling; disabled
graph_2 = QuickGraph(round.Floor, SortOrder=0)  # disabled
bnd = Bounds(Numbers=round.Floor)  # disabled
dedomain_2 = DeconstructDomain(Domain=bnd)  # -> Start, End; disabled
pt_2 = ConstructPoint(XCoordinate=pdecon_2.XComponent, YCoordinate=pdecon_2.YComponent, ZCoordinate=0)  # disabled
panel_31 = Panel("-13")  # disabled
panel_32 = Panel("1")  # disabled
gradient = Gradient(
    LowerLimit=panel_32,
    UpperLimit=panel_31,
    Parameter=round.Floor,
    stops=[0: RGB(255, 255, 255), 0.0312: RGB(247, 247, 247), 0.0625: RGB(238, 238, 238), 0.0938: RGB(230, 230, 230), 0.125: RGB(223, 223, 223), 0.156: RGB(215, 215, 215)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])  # disabled
conmesh_2 = ConstructMesh(Vertices=pt_2, Faces=demesh_3.Faces, Colours=gradient)  # disabled

# ----
# 4 Cull Dry Cells
# CullMeshes
# Read Dry Cells-Corresponding Face Indexes
panel_33 = Panel("Results/Unsteady/Output/Output Blocks/Base Output/Unsteady Time Series/2D Flow Areas/2D_Domain/Cell Hydraulic Depth")
hecras_reader_4 = Python3Script(ResultPath=panel_33, QueryTimeIndex=number_slider, LiveUpdate=toggle, Run=Button())  # -> Values, SelectedTimeIndex, SelectedTimestamp, Status
# ---------- hecras_reader_4: Python ----------
# requirements: h5py
import h5py
import scriptcontext as sc
import os


# -----------------------------
# Sticky keys / global constants
# -----------------------------

HDF_PATH_KEY = "HDF_PATH"
TIME_DATE_STAMP_PATH_KEY = "TIME_DATE_STAMP_PATH"

# Generic cache keys
HECRAS_RESULT_VALUES_KEY = "HECRAS_RESULT_VALUES"
HECRAS_RESULT_VALUE_COUNT_KEY = "HECRAS_RESULT_VALUE_COUNT"
HECRAS_RESULT_PATH_KEY = "HECRAS_RESULT_PATH"
HECRAS_RESULT_NAME_KEY = "HECRAS_RESULT_NAME"
HECRAS_RESULT_DATASET_SHAPE_KEY = "HECRAS_RESULT_DATASET_SHAPE"

HECRAS_SELECTED_TIME_INDEX_KEY = "HECRAS_SELECTED_TIME_INDEX"
HECRAS_SELECTED_TIMESTAMP_KEY = "HECRAS_SELECTED_TIMESTAMP"


# -----------------------------
# Helpers
# -----------------------------

def decode_hdf5_string(value):
    if isinstance(value, bytes):
        return value.decode("utf-8", errors="replace")
    return str(value)


def is_empty(value):
    if value is None:
        return True
    if isinstance(value, str) and value.strip() == "":
        return True
    return False


def as_bool(value):
    """
    Grasshopper-safe bool conversion.
    """
    if value is None:
        return False
    return bool(value)


def normalize_timestamp(value):
    return decode_hdf5_string(value).strip()


def normalize_hdf5_path(path):
    """
    Grasshopper-safe path cleanup.
    Allows paths with or without leading slash.
    """
    if is_empty(path):
        return ""

    clean_path = str(path).strip()

    # h5py accepts both, but keeping no leading slash is cleaner
    while clean_path.startswith("/"):
        clean_path = clean_path[1:]

    return clean_path


def get_result_name(result_path):
    """
    Get readable result name from HDF5 path.
    Example:
        .../Water Surface -> Water Surface
        .../Face Shear Stress -> Face Shear Stress
    """
    clean_path = normalize_hdf5_path(result_path)

    if not clean_path:
        return ""

    return clean_path.split("/")[-1]


def read_all_timestamps(hdf_path, timestamp_path):
    if not timestamp_path:
        return []

    timestamp_path = normalize_hdf5_path(timestamp_path)

    with h5py.File(hdf_path, "r") as hdf_file:
        raw_timestamps = hdf_file[timestamp_path][()]

    return [normalize_timestamp(t) for t in raw_timestamps]


def get_dataset_shape(hdf_path, result_path):
    """
    Check result dataset shape.
    Expected for time-varying 2D result:
        (time_count, value_count)

    Examples:
        Water Surface:
            (time_count, cell_count)

        Face Shear Stress:
            (time_count, face_count)
    """
    result_path = normalize_hdf5_path(result_path)

    with h5py.File(hdf_path, "r") as hdf_file:
        if result_path not in hdf_file:
            raise ValueError("ResultPath not found in HDF5: {}".format(result_path))

        dataset_shape = hdf_file[result_path].shape

    if len(dataset_shape) != 2:
        raise ValueError(
            "Expected result dataset shape (time, values), got {} for path '{}'.".format(
                dataset_shape,
                result_path
            )
        )

    return dataset_shape


def get_time_count(hdf_path, result_path):
    dataset_shape = get_dataset_shape(hdf_path, result_path)
    return dataset_shape[0]


def read_selected_result_values(hdf_path, result_path, time_index):
    """
    Read one timestep from a generic HDF5 result dataset.
    Returns one list of values.

    Expected shape:
        (time_count, value_count)
    """
    result_path = normalize_hdf5_path(result_path)

    with h5py.File(hdf_path, "r") as hdf_file:
        if result_path not in hdf_file:
            raise ValueError("ResultPath not found in HDF5: {}".format(result_path))

        dataset = hdf_file[result_path]
        dataset_shape = dataset.shape

        if len(dataset_shape) != 2:
            raise ValueError(
                "Expected result dataset shape (time, values), got {} for path '{}'.".format(
                    dataset_shape,
                    result_path
                )
            )

        time_count = dataset_shape[0]

        if time_index < 0 or time_index >= time_count:
            raise ValueError(
                "QueryTimeIndex {} out of range. Valid range: 0 to {}.".format(
                    time_index,
                    time_count - 1
                )
            )

        raw_values = dataset[time_index, :]

    return [float(value) for value in raw_values]


def resolve_time_query(query_time_index, query_time_stamp, timestamps, time_count):
    has_index = not is_empty(query_time_index)
    has_stamp = not is_empty(query_time_stamp)

    if not has_index and not has_stamp:
        return None, None, "Idle: provide QueryTimeIndex or QueryTimeStamp."

    selected_index_from_index = None
    selected_index_from_stamp = None

    # Resolve from QueryTimeIndex
    if has_index:
        try:
            selected_index_from_index = int(query_time_index)
        except:
            raise ValueError("QueryTimeIndex must be an integer.")

        if selected_index_from_index < 0 or selected_index_from_index >= time_count:
            raise ValueError(
                "QueryTimeIndex {} out of range. Valid range: 0 to {}.".format(
                    selected_index_from_index,
                    time_count - 1
                )
            )

    # Resolve from QueryTimeStamp
    if has_stamp:
        if not timestamps:
            raise ValueError(
                "QueryTimeStamp was provided, but timestamps are not available. Check TIME_DATE_STAMP_PATH."
            )

        target_stamp = normalize_timestamp(query_time_stamp)

        if target_stamp not in timestamps:
            raise ValueError(
                "QueryTimeStamp not found: '{}'. Disable QueryTimeStamp or choose a valid timestamp.".format(
                    target_stamp
                )
            )

        selected_index_from_stamp = timestamps.index(target_stamp)

    # If both are provided, they must align
    if has_index and has_stamp:
        if selected_index_from_index != selected_index_from_stamp:
            index_stamp = timestamps[selected_index_from_index] if timestamps else ""

            raise ValueError(
                "QueryTimeIndex and QueryTimeStamp are not aligned. "
                "QueryTimeIndex {} corresponds to '{}', but QueryTimeStamp corresponds to TimeIndex {}. "
                "Please align them or disable one query input.".format(
                    selected_index_from_index,
                    index_stamp,
                    selected_index_from_stamp
                )
            )

        selected_index = selected_index_from_index
        selected_stamp = timestamps[selected_index] if timestamps else ""
        return selected_index, selected_stamp, "Resolved: QueryTimeIndex and QueryTimeStamp are aligned."

    # Only QueryTimeIndex provided
    if has_index:
        selected_index = selected_index_from_index
        selected_stamp = timestamps[selected_index] if timestamps else ""
        return selected_index, selected_stamp, "Resolved: selected timestep from QueryTimeIndex."

    # Only QueryTimeStamp provided
    selected_index = selected_index_from_stamp
    selected_stamp = timestamps[selected_index]
    return selected_index, selected_stamp, "Resolved: selected timestep from QueryTimeStamp."


# -----------------------------
# Default outputs
# -----------------------------

Values = []
ValueCount = 0
SelectedTimeIndex = None
SelectedTimestamp = None
ResultName = ""
DatasetShape = None
Status = "Idle: provide ResultPath and QueryTimeIndex or QueryTimeStamp."


# -----------------------------
# Grasshopper execution
# -----------------------------

try:
    hdf_path = sc.sticky.get(HDF_PATH_KEY)
    timestamp_path = sc.sticky.get(TIME_DATE_STAMP_PATH_KEY)

    run_update = as_bool(Run)
    live_update = as_bool(LiveUpdate)
    should_update = run_update or live_update

    if not hdf_path:
        raise ValueError("{} not found in sc.sticky.".format(HDF_PATH_KEY))

    if is_empty(ResultPath):
        raise ValueError("ResultPath input is empty.")

    result_path = normalize_hdf5_path(ResultPath)
    result_name = get_result_name(result_path)

    dataset_shape = get_dataset_shape(hdf_path, result_path)
    time_count = dataset_shape[0]
    values_per_timestep = dataset_shape[1]

    timestamps = read_all_timestamps(hdf_path, timestamp_path)

    selected_time_index, selected_timestamp, resolve_status = resolve_time_query(
        QueryTimeIndex,
        QueryTimeStamp,
        timestamps,
        time_count
    )

    # If neither query is provided
    if selected_time_index is None:
        Values = sc.sticky.get(HECRAS_RESULT_VALUES_KEY, [])
        ValueCount = len(Values)
        SelectedTimeIndex = sc.sticky.get(HECRAS_SELECTED_TIME_INDEX_KEY, None)
        SelectedTimestamp = sc.sticky.get(HECRAS_SELECTED_TIMESTAMP_KEY, None)
        ResultName = result_name
        DatasetShape = dataset_shape

        Status = "{} Result '{}', shape {}.".format(
            resolve_status,
            result_name,
            dataset_shape
        )

    # Query is valid, but neither Run nor LiveUpdate is active
    elif not should_update:
        cached_path = sc.sticky.get(HECRAS_RESULT_PATH_KEY, "")
        cached_values = sc.sticky.get(HECRAS_RESULT_VALUES_KEY, [])

        Values = cached_values
        ValueCount = len(cached_values)

        SelectedTimeIndex = sc.sticky.get(
            HECRAS_SELECTED_TIME_INDEX_KEY,
            selected_time_index
        )
        SelectedTimestamp = sc.sticky.get(
            HECRAS_SELECTED_TIMESTAMP_KEY,
            selected_timestamp
        )

        ResultName = result_name
        DatasetShape = dataset_shape

        if cached_values and cached_path == result_path:
            Status = (
                "{} Cached: {} values available for result '{}'. "
                "Turn on LiveUpdate or press Run to update to TimeIndex {}, Timestamp '{}'."
            ).format(
                resolve_status,
                len(cached_values),
                result_name,
                selected_time_index,
                selected_timestamp
            )
        elif cached_values and cached_path != result_path:
            Status = (
                "{} Warning: cached values are from a different ResultPath. "
                "Current ResultPath is '{}'. Cached ResultPath is '{}'. "
                "Turn on LiveUpdate or press Run to read the current result."
            ).format(
                resolve_status,
                result_path,
                cached_path
            )
        else:
            Status = (
                "{} Ready: result '{}' found with shape {}. "
                "Turn on LiveUpdate or press Run to read values."
            ).format(
                resolve_status,
                result_name,
                dataset_shape
            )

    # Query is valid and Run or LiveUpdate is active
    else:
        values = read_selected_result_values(
            hdf_path,
            result_path,
            selected_time_index
        )

        sc.sticky[HECRAS_RESULT_VALUES_KEY] = values
        sc.sticky[HECRAS_RESULT_VALUE_COUNT_KEY] = len(values)
        sc.sticky[HECRAS_RESULT_PATH_KEY] = result_path
        sc.sticky[HECRAS_RESULT_NAME_KEY] = result_name
        sc.sticky[HECRAS_RESULT_DATASET_SHAPE_KEY] = dataset_shape

        sc.sticky[HECRAS_SELECTED_TIME_INDEX_KEY] = selected_time_index
        sc.sticky[HECRAS_SELECTED_TIMESTAMP_KEY] = selected_timestamp

        Values = values
        ValueCount = len(values)
        SelectedTimeIndex = selected_time_index
        SelectedTimestamp = selected_timestamp
        ResultName = result_name
        DatasetShape = dataset_shape

        update_mode = "LiveUpdate" if live_update and not run_update else "Run"

        Status = (
            "Success [{}]: loaded {} values from result '{}' at TimeIndex {}, Timestamp '{}'. "
            "Dataset shape: {}."
        ).format(
            update_mode,
            len(values),
            result_name,
            selected_time_index,
            selected_timestamp,
            dataset_shape
        )

except Exception as error:
    Values = []
    ValueCount = 0
    SelectedTimeIndex = None
    SelectedTimestamp = None
    ResultName = ""
    DatasetShape = None
    Status = "Failed: {}".format(error)
# ---------- end hecras_reader_4 ----------
panel_34 = Panel(hecras_reader_4.SelectedTimestamp)
panel_35 = Panel(hecras_reader_4.SelectedTimeIndex)
panel_36 = Panel(hecras_reader_4.Status)
panel_37 = Panel(hecras_reader_4.Values)

# ---- group: Python 3 Script
# FaceIndexes that is Only on DryCells
# HECRASCellIndexes
# IsDryCell
panel_38 = Panel("0")
smaller_2 = SmallerThan(FirstNumber=hecras_reader_4.Values, SecondNumber=panel_38)  # -> SmallerThan, OrEqualTo
num_2 = Number(py3_4.HECRASCellIndexes)
item_2 = ListItem(List=smaller_2.OrEqualTo, Index=num_2, Wrap=True)

# ----
py3_8 = Python3Script(HECRASCellIndexes=num_2, IsDryCell=item_2)  # -> out, DryCellIndexes; inputs HECRASCellIndexes: list of Double, IsDryCell: list of Boolean
# ---------- py3_8: Python ----------
DryCellIndexes = []

if HECRASCellIndexes is not None and IsDryCell is not None:
    for cell_index, is_dry in zip(HECRASCellIndexes, IsDryCell):
        if is_dry:
            DryCellIndexes.append(cell_index)
# ---------- end py3_8 ----------
py3_9 = Python3Script(CellMesh=mesh_3, HECRASCellIndexes=num_2, DryCellIndexes=py3_8.DryCellIndexes, LiveUpdate=toggle, Run=Button())  # -> out, CulledMesh, CulledHECRASCellIndexes, Status; inputs CellMesh: Mesh, HECRASCellIndexes: list, DryCellIndexes: list
# ---------- py3_9: Python ----------
# -*- coding: utf-8 -*-

import Rhino.Geometry as rg
import scriptcontext as sc


# Inputs:
#   CellMesh              Item Access
#   HECRASCellIndexes     List Access
#   DryCellIndexes        List Access
#   LiveUpdate            Item Access, bool
#   Run                   Item Access, bool / Button
#
# Outputs:
#   CulledMesh
#   CulledHECRASCellIndexes
#   Status


# -----------------------------
# Sticky keys
# -----------------------------

HECRAS_CULLED_MESH_KEY = "HECRAS_CULLED_MESH"
HECRAS_CULLED_CELL_INDEXES_KEY = "HECRAS_CULLED_CELL_INDEXES"
HECRAS_CULLED_STATUS_KEY = "HECRAS_CULLED_STATUS"


# -----------------------------
# Helpers
# -----------------------------

def as_bool(value):
    if value is None:
        return False
    return bool(value)


def to_int_set(values):
    result = set()

    if values is None:
        return result

    for v in values:
        try:
            result.add(int(v))
        except:
            pass

    return result


def cull_dry_faces(cell_mesh, hecras_cell_indexes, dry_cell_indexes):
    if cell_mesh is None:
        raise ValueError("CellMesh is None.")

    if hecras_cell_indexes is None:
        raise ValueError("HECRASCellIndexes is None.")

    face_count = cell_mesh.Faces.Count
    index_count = len(hecras_cell_indexes)

    if face_count != index_count:
        raise ValueError(
            "CellMesh face count ({}) does not match HECRASCellIndexes count ({}). "
            "Expected: CellMesh.Faces[i] -> HECRASCellIndexes[i]."
            .format(face_count, index_count)
        )

    dry_set = to_int_set(dry_cell_indexes)

    new_mesh = rg.Mesh()
    new_cell_indexes = []

    vertex_map = {}

    def add_vertex(old_vi):
        if old_vi in vertex_map:
            return vertex_map[old_vi]

        v = cell_mesh.Vertices[old_vi]
        new_vi = new_mesh.Vertices.Add(v)
        vertex_map[old_vi] = new_vi
        return new_vi

    removed_count = 0

    for face_i in range(face_count):
        hec_idx = int(hecras_cell_indexes[face_i])

        if hec_idx in dry_set:
            removed_count += 1
            continue

        face = cell_mesh.Faces[face_i]

        a = add_vertex(face.A)
        b = add_vertex(face.B)
        c = add_vertex(face.C)

        if face.IsQuad:
            d = add_vertex(face.D)
            new_mesh.Faces.AddFace(a, b, c, d)
        else:
            new_mesh.Faces.AddFace(a, b, c)

        new_cell_indexes.append(hec_idx)

    new_mesh.Normals.ComputeNormals()
    new_mesh.Compact()

    status = (
        "Success: kept {} faces, removed {} dry faces. "
        "CulledHECRASCellIndexes count = {}."
    ).format(
        len(new_cell_indexes),
        removed_count,
        len(new_cell_indexes)
    )

    return new_mesh, new_cell_indexes, status


# -----------------------------
# Default cached outputs
# -----------------------------

CulledMesh = sc.sticky.get(HECRAS_CULLED_MESH_KEY, None)
CulledHECRASCellIndexes = sc.sticky.get(HECRAS_CULLED_CELL_INDEXES_KEY, [])
Status = sc.sticky.get(
    HECRAS_CULLED_STATUS_KEY,
    "Idle: press Run or enable LiveUpdate to cull dry faces."
)


# -----------------------------
# Grasshopper execution
# -----------------------------

try:
    should_update = as_bool(Run) or as_bool(LiveUpdate)

    if not should_update:
        if CulledMesh is None:
            Status = "Ready: press Run or enable LiveUpdate to cull dry faces."
        else:
            Status = (
                "Cached: culled mesh available with {} HECRAS cell indexes. "
                "Press Run or enable LiveUpdate to update."
            ).format(len(CulledHECRASCellIndexes))

    else:
        CulledMesh, CulledHECRASCellIndexes, Status = cull_dry_faces(
            CellMesh,
            HECRASCellIndexes,
            DryCellIndexes
        )

        sc.sticky[HECRAS_CULLED_MESH_KEY] = CulledMesh
        sc.sticky[HECRAS_CULLED_CELL_INDEXES_KEY] = CulledHECRASCellIndexes
        sc.sticky[HECRAS_CULLED_STATUS_KEY] = Status

except Exception as error:
    CulledMesh = None
    CulledHECRASCellIndexes = []
    Status = "Failed: {}".format(error)
# ---------- end py3_9 ----------
mesh_6 = Mesh(py3_9.CulledMesh)
panel_39 = Panel(py3_9.CulledHECRASCellIndexes)
panel_40 = Panel(py3_9.Status)

num_3 = Number(py3_9.CulledHECRASCellIndexes)
num_4 = Number(py3_2.a)

# ---- group: Gradient
item_3 = ListItem(List=filter, Index=num_3, Wrap=True)
bnd_2 = Bounds(Numbers=item_3)

# ----
# Current Data Range
panel_41 = Panel(bnd_2)

gate = StreamGate(Stream=item_3, Gate=num_4)  # -> Target0, Target1, Target2
gradient_2 = Gradient(
    LowerLimit=dedomain.Start,
    UpperLimit=dedomain.End,
    Parameter=gate.Target1,
    stops=[0: RGB(247, 250, 255), 0.0312: RGB(240, 246, 252), 0.0625: RGB(234, 242, 250), 0.0938: RGB(228, 238, 248), 0.125: RGB(221, 234, 246), 0.156: RGB(215, 230, 244)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])
gradient_3 = Gradient(
    LowerLimit=dedomain.Start,
    UpperLimit=dedomain.End,
    Parameter=gate.Target2,
    stops=[0: RGB(0, 127, 102), 0.0312: RGB(7, 131, 102), 0.0625: RGB(16, 135, 102), 0.0938: RGB(24, 139, 102), 0.125: RGB(31, 143, 102), 0.156: RGB(39, 147, 102)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])

# ---- group: Gradient (continued)
gradient_4 = Gradient(
    LowerLimit=dedomain.Start,
    UpperLimit=dedomain.End,
    Parameter=gate.Target0,
    stops=[0: RGB(48, 18, 59), 0.0312: RGB(57, 41, 114), 0.0625: RGB(64, 64, 161), 0.0938: RGB(68, 86, 199), 0.125: RGB(70, 107, 227), 0.156: RGB(70, 127, 246)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])

# ----
# HDF5 - Face Value → FacePoint Value Interpolator
filter_2 = StreamFilter(Gate=num_4, Stream0=gradient_4, Stream1=gradient_2, Stream2=gradient_3)
mesh_paint = MeshColorByFace(Mesh=mesh_6, Colors=filter_2)

# ----
# 7 Legend Display
# Timestamp Legend
gradient_5 = Gradient(
    LowerLimit=0,
    UpperLimit=1,
    stops=[0: RGB(247, 250, 255), 0.0312: RGB(240, 246, 252), 0.0625: RGB(234, 242, 250), 0.0938: RGB(228, 238, 248), 0.125: RGB(221, 234, 246), 0.156: RGB(215, 230, 244)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])
gradient_6 = Gradient(
    LowerLimit=0,
    UpperLimit=1,
    stops=[0: RGB(48, 18, 59), 0.0312: RGB(57, 41, 114), 0.0625: RGB(64, 64, 161), 0.0938: RGB(68, 86, 199), 0.125: RGB(70, 107, 227), 0.156: RGB(70, 127, 246)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])
gradient_7 = Gradient(
    LowerLimit=0,
    UpperLimit=1,
    stops=[0: RGB(0, 127, 102), 0.0312: RGB(7, 131, 102), 0.0625: RGB(16, 135, 102), 0.0938: RGB(24, 139, 102), 0.125: RGB(31, 143, 102), 0.156: RGB(39, 147, 102)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])
c_script = CSharpScript(gradient=gradient_7)  # -> out, isLinear, isLocked, gripCount, gripParameters, gripColourLeft, gripColourRight, status
# ---------- c_script: C# ----------
#region Usings
using System;
using System.Collections;
using System.Collections.Generic;
using System.Drawing;

using Rhino;
using Rhino.Geometry;

using Grasshopper;
using Grasshopper.Kernel;
using Grasshopper.Kernel.Data;
using Grasshopper.Kernel.Types;
using Grasshopper.Kernel.Special;
#endregion

public class Script_Instance : GH_ScriptInstance
{
    private void RunScript(
		object gradient,
		ref object isLinear,
		ref object isLocked,
		ref object gripCount,
		ref object gripParameters,
		ref object gripColourLeft,
		ref object gripColourRight,
		ref object status)
    {
        try
        {
            // ------------------------------------------------------------
            // Validate input source
            // ------------------------------------------------------------

            if (Component.Params.Input[0].Sources.Count == 0)
            {
                isLinear = null;
                isLocked = null;
                gripCount = 0;
                gripParameters = new List<double>();
                gripColourLeft = new List<Color>();
                gripColourRight = new List<Color>();
                status = "No Gradient component connected to the input.";
                return;
            }

            // ------------------------------------------------------------
            // Get the connected Grasshopper Gradient component
            // ------------------------------------------------------------

            IGH_Param sourceParam = Component.Params.Input[0].Sources[0];
            IGH_DocumentObject topLevelObject = sourceParam.Attributes.GetTopLevel.DocObject;

            GH_GradientControl gradientControl = topLevelObject as GH_GradientControl;

            if (gradientControl == null)
            {
                isLinear = null;
                isLocked = null;
                gripCount = 0;
                gripParameters = new List<double>();
                gripColourLeft = new List<Color>();
                gripColourRight = new List<Color>();
                status = "Connected source is not a Grasshopper Gradient component.";
                return;
            }

            // ------------------------------------------------------------
            // Read live gradient data
            // ------------------------------------------------------------

            var g = gradientControl.Gradient;

            List<double> parameters = new List<double>();
            List<Color> colourLeft = new List<Color>();
            List<Color> colourRight = new List<Color>();

            for (int i = 0; i < g.GripCount; i++)
            {
                parameters.Add(g[i].Parameter);
                colourLeft.Add(g[i].ColourLeft);
                colourRight.Add(g[i].ColourRight);
            }

            // ------------------------------------------------------------
            // Output
            // ------------------------------------------------------------

            isLinear = g.Linear;
            isLocked = g.Locked;
            gripCount = g.GripCount;
            gripParameters = parameters;
            gripColourLeft = colourLeft;
            gripColourRight = colourRight;

            status = "Gradient read successfully. Grip count: " + g.GripCount.ToString();
        }
        catch (Exception ex)
        {
            isLinear = null;
            isLocked = null;
            gripCount = 0;
            gripParameters = new List<double>();
            gripColourLeft = new List<Color>();
            gripColourRight = new List<Color>();

            status = "Failed to read gradient: " + ex.Message;
        }
    }
}
# ---------- end c_script ----------
c_script_2 = CSharpScript(gradient=gradient_5)  # -> out, isLinear, isLocked, gripCount, gripParameters, gripColourLeft, gripColourRight, status; same code as c_script
c_script_3 = CSharpScript(gradient=gradient_6)  # -> out, isLinear, isLocked, gripCount, gripParameters, gripColourLeft, gripColourRight, status; same code as c_script
toggle_2 = BooleanToggle(True)
# Color Legend
toggle_3 = BooleanToggle(False)
dedomain_3 = DeconstructDomain(Domain=panel_15)  # -> Start, End
c_script_4 = CSharpScript(show=toggle_2, reset=Toggle(False), timestamp=hecras_reader_3.SelectedTimestamp)  # -> out, a; inputs show: Boolean, reset: Boolean, timestamp: String
# ---------- c_script_4: C# ----------
// Grasshopper Script Instance
#region Usings
using System;
using System.Linq;
using System.Collections;
using System.Collections.Generic;
using System.Drawing;

using Rhino;
using Rhino.Geometry;
using Rhino.Display;

using Grasshopper;
using Grasshopper.Kernel;
using Grasshopper.Kernel.Data;
using Grasshopper.Kernel.Types;
#endregion

public class Script_Instance : GH_ScriptInstance
{
    #region Notes
    /* 
      Members:
        RhinoDoc RhinoDocument
        GH_Document GrasshopperDocument
        IGH_Component Component
        int Iteration
    */
    #endregion


    // ------------------------------------------------------------
    // Instance fields
    // ------------------------------------------------------------

    DrawTimestampConduit _conduit;

    // Each compiled script instance gets a unique token.
    // Old compiled instances will have old tokens.
    string _token = Guid.NewGuid().ToString();


    private void RunScript(bool show, bool reset, string timestamp, ref object a)
    {
        // ------------------------------------------------------------
        // Create conduit for this compiled instance
        // ------------------------------------------------------------

        if (_conduit == null)
        {
            _conduit = new DrawTimestampConduit();
            _conduit.Token = _token;
        }


        // ------------------------------------------------------------
        // Reset / kill switch
        // ------------------------------------------------------------

        if (reset)
        {
            // Clear the active token.
            // Any old conduit that checks this will disable itself.
            RhinoDocument.Strings.SetString(
                "GH_TIMESTAMP_CONDUIT",
                "ACTIVE_TOKEN",
                ""
            );

            if (_conduit != null)
            {
                _conduit.Enabled = false;

                if (_conduit.TimestampBitmap != null)
                {
                    _conduit.TimestampBitmap.Dispose();
                    _conduit.TimestampBitmap = null;
                }
            }

            RhinoDocument.Views.Redraw();

            a = "Timestamp reset. Old timestamp conduits will self-disable on redraw.";
            return;
        }


        // ------------------------------------------------------------
        // Normal off
        // ------------------------------------------------------------

        if (!show)
        {
            if (_conduit != null)
            {
                _conduit.Enabled = false;

                if (_conduit.TimestampBitmap != null)
                {
                    _conduit.TimestampBitmap.Dispose();
                    _conduit.TimestampBitmap = null;
                }
            }

            RhinoDocument.Views.Redraw();

            a = "Timestamp off.";
            return;
        }


        // ------------------------------------------------------------
        // This instance claims ownership
        // ------------------------------------------------------------

        RhinoDocument.Strings.SetString(
            "GH_TIMESTAMP_CONDUIT",
            "ACTIVE_TOKEN",
            _token
        );


        // ------------------------------------------------------------
        // Default timestamp
        // ------------------------------------------------------------

        if (String.IsNullOrWhiteSpace(timestamp))
            timestamp = "No timestamp selected";


        // ------------------------------------------------------------
        // Create timestamp bitmap
        // ------------------------------------------------------------

        Bitmap bmp = CreateTimestampBitmap(timestamp);


        // ------------------------------------------------------------
        // Update conduit
        // ------------------------------------------------------------

        if (_conduit.TimestampBitmap != null)
        {
            _conduit.TimestampBitmap.Dispose();
            _conduit.TimestampBitmap = null;
        }

        _conduit.Token = _token;
        _conduit.TimestampBitmap = bmp;
        _conduit.Enabled = true;

        RhinoDocument.Views.Redraw();

        a = "Viewport timestamp on.";
    }


    Bitmap CreateTimestampBitmap(string timestamp)
    {
        // ------------------------------------------------------------
        // Padding
        // ------------------------------------------------------------

        int padX = 12;
        int padY = 10;

        using (Font font = new Font("Arial", 11, FontStyle.Bold))
        {
            // ------------------------------------------------------------
            // Measure text first, then size bitmap to fit text
            // ------------------------------------------------------------

            using (Bitmap tempBmp = new Bitmap(1, 1))
            using (Graphics tempG = Graphics.FromImage(tempBmp))
            {
                tempG.TextRenderingHint = System.Drawing.Text.TextRenderingHint.AntiAliasGridFit;

                SizeF textSize = tempG.MeasureString(timestamp, font);

                int width = (int)Math.Ceiling(textSize.Width) + padX * 2;
                int height = (int)Math.Ceiling(textSize.Height) + padY * 2;

                Bitmap bmp = new Bitmap(width, height);

                using (Graphics g = Graphics.FromImage(bmp))
                {
                    g.SmoothingMode = System.Drawing.Drawing2D.SmoothingMode.AntiAlias;
                    g.TextRenderingHint = System.Drawing.Text.TextRenderingHint.AntiAliasGridFit;

                    g.Clear(Color.FromArgb(220, 255, 255, 255));

                    using (Pen borderPen = new Pen(Color.FromArgb(180, 80, 80, 80), 1))
                    using (Brush textBrush = new SolidBrush(Color.Black))
                    {
                        g.DrawRectangle(borderPen, 0, 0, width - 1, height - 1);

                        g.DrawString(
                            timestamp,
                            font,
                            textBrush,
                            padX,
                            padY
                        );
                    }
                }

                return bmp;
            }
        }
    }


    class DrawTimestampConduit : DisplayConduit
    {
        public Bitmap TimestampBitmap;
        public string Token;

        protected override void DrawForeground(DrawEventArgs e)
        {
            string activeToken = RhinoDoc.ActiveDoc.Strings.GetValue(
                "GH_TIMESTAMP_CONDUIT",
                "ACTIVE_TOKEN"
            );

            // If this conduit belongs to an old compiled script instance,
            // disable it automatically.
            if (activeToken != Token)
            {
                this.Enabled = false;

                if (TimestampBitmap != null)
                {
                    TimestampBitmap.Dispose();
                    TimestampBitmap = null;
                }

                return;
            }

            if (TimestampBitmap == null)
                return;

            // Position below the legend.
            e.Display.DrawBitmap(new DisplayBitmap(TimestampBitmap), 50, 255);
        }
    }
}
# ---------- end c_script_4 ----------

filter_3 = StreamFilter(Gate=num_4, Stream0=c_script_3.gripColourLeft, Stream1=c_script_2.gripColourLeft, Stream2=c_script.gripColourLeft)

split = TextSplit(Text=filter_3, Separators=",")  # -> simplify(Result)
item_4 = ListItem(List=split, Index=0, Wrap=True)  # -> flatten(Item), flatten(Item1), flatten(Item2)
rgb = ColourRGB(Alpha=255, Red=item_4.Item, Green=item_4.Item1, Blue=item_4.Item2)
legend_color_col = Colour(rgb)
c_script_5 = CSharpScript(
    show=toggle_2,
    reset=toggle_3,
    colors=legend_color_col,
    minValue=dedomain_3.Start,
    maxValue=dedomain_3.End,
    title=py3.DatasetTitle,
    unit=hecras_reader_3.DatasetUnit)  # -> out, a; inputs show: Boolean, reset: Boolean, colors: list of Color, minValue: Double, maxValue: Double, title: String, unit: String
# ---------- c_script_5: C# ----------
// Grasshopper Script Instance
#region Usings
using System;
using System.Linq;
using System.Collections;
using System.Collections.Generic;
using System.Drawing;

using Rhino;
using Rhino.Geometry;
using Rhino.Display;

using Grasshopper;
using Grasshopper.Kernel;
using Grasshopper.Kernel.Data;
using Grasshopper.Kernel.Types;
#endregion

public class Script_Instance : GH_ScriptInstance
{
    #region Notes
    /* 
      Members:
        RhinoDoc RhinoDocument
        GH_Document GrasshopperDocument
        IGH_Component Component
        int Iteration
    */
    #endregion


    // ------------------------------------------------------------
    // Instance fields
    // ------------------------------------------------------------

    DrawLegendConduit _conduit;

    // Each compiled script instance gets a unique token.
    // Old compiled instances will have old tokens.
    string _token = Guid.NewGuid().ToString();


    private void RunScript(
		bool show,
		bool reset,
		List<Color> colors,
		double minValue,
		double maxValue,
		string title,
		string unit,
		ref object a)
    {
        // ------------------------------------------------------------
        // Create conduit for this compiled instance
        // ------------------------------------------------------------

        if (_conduit == null)
        {
            _conduit = new DrawLegendConduit();
            _conduit.Token = _token;
        }


        // ------------------------------------------------------------
        // Reset overrides show
        // ------------------------------------------------------------

        if (reset)
        {
            RhinoDocument.Strings.SetString(
                "GH_LEGEND_CONDUIT",
                "ACTIVE_TOKEN",
                ""
            );

            if (_conduit != null)
            {
                _conduit.Enabled = false;

                if (_conduit.Legend != null)
                {
                    _conduit.Legend.Dispose();
                    _conduit.Legend = null;
                }
            }

            RhinoDocument.Views.Redraw();

            a = "Legend reset. Old conduits will self-disable on redraw.";
            return;
        }


        // ------------------------------------------------------------
        // Normal off
        // ------------------------------------------------------------

        if (!show)
        {
            if (_conduit != null)
            {
                _conduit.Enabled = false;

                if (_conduit.Legend != null)
                {
                    _conduit.Legend.Dispose();
                    _conduit.Legend = null;
                }
            }

            RhinoDocument.Views.Redraw();

            a = "Legend off.";
            return;
        }


        // ------------------------------------------------------------
        // This instance claims ownership
        // ------------------------------------------------------------

        RhinoDocument.Strings.SetString(
            "GH_LEGEND_CONDUIT",
            "ACTIVE_TOKEN",
            _token
        );


        // ------------------------------------------------------------
        // Default inputs
        // ------------------------------------------------------------

        if (colors == null || colors.Count < 2)
        {
            colors = new List<Color>();
            colors.Add(Color.Blue);
            colors.Add(Color.White);
            colors.Add(Color.Red);
        }

        if (String.IsNullOrWhiteSpace(title))
            title = "Legend";

        if (String.IsNullOrWhiteSpace(unit))
            unit = "";


        // ------------------------------------------------------------
        // Create legend bitmap
        // ------------------------------------------------------------

        Bitmap legend = CreateLegendBitmap(
            colors,
            minValue,
            maxValue,
            title,
            unit
        );


        // ------------------------------------------------------------
        // Update conduit
        // ------------------------------------------------------------

        if (_conduit.Legend != null)
        {
            _conduit.Legend.Dispose();
            _conduit.Legend = null;
        }

        _conduit.Token = _token;
        _conduit.Legend = legend;
        _conduit.Enabled = true;

        RhinoDocument.Views.Redraw();

        a = "Viewport gradient legend on.";
    }


    Bitmap CreateLegendBitmap(
        List<Color> colors,
        double minValue,
        double maxValue,
        string title,
        string unit)
    {
        // ------------------------------------------------------------
        // Overall legend size
        // ------------------------------------------------------------

        int width = 145;
        int height = 205;

        // Consistent padding
        int pad = 12;

        // Header layout
        int titleY = pad;
        int unitY = titleY + 21;

        // Bar layout
        int barX = pad;
        int barY = unitY + 22;
        int barW = 18;
        int barH = 130;

        // Label layout
        int labelGap = 8;
        int labelX = barX + barW + labelGap;

        Bitmap legend = new Bitmap(width, height);

        using (Graphics g = Graphics.FromImage(legend))
        {
            g.SmoothingMode = System.Drawing.Drawing2D.SmoothingMode.AntiAlias;
            g.TextRenderingHint = System.Drawing.Text.TextRenderingHint.AntiAliasGridFit;

            // Background
            g.Clear(Color.FromArgb(225, 255, 255, 255));

            using (Pen borderPen = new Pen(Color.FromArgb(160, 90, 90, 90), 1))
            using (Pen barBorderPen = new Pen(Color.FromArgb(190, 70, 70, 70), 1))
            using (Brush textBrush = new SolidBrush(Color.FromArgb(25, 25, 25)))
            using (Brush mutedBrush = new SolidBrush(Color.FromArgb(90, 90, 90)))
            using (Font titleFont = new Font("Arial", 10, FontStyle.Bold))
            using (Font labelFont = new Font("Arial", 9))
            using (Font unitFont = new Font("Arial", 8))
            {
                // Outer border
                g.DrawRectangle(borderPen, 0, 0, width - 1, height - 1);

                // Title
                g.DrawString(title, titleFont, textBrush, pad, titleY);

                // Unit appears once only
                if (!String.IsNullOrWhiteSpace(unit))
                {
                    g.DrawString(unit, unitFont, mutedBrush, pad, unitY);
                }

                // ------------------------------------------------------------
                // Continuous color gradient bar
                // ------------------------------------------------------------

                for (int y = 0; y < barH; y++)
                {
                    // top = max, bottom = min
                    double t = 1.0 - (double)y / Math.Max(1, barH - 1);
                    Color c = InterpolateColor(colors, t);

                    using (Pen p = new Pen(c, 1))
                    {
                        g.DrawLine(
                            p,
                            barX,
                            barY + y,
                            barX + barW,
                            barY + y
                        );
                    }
                }

                // Bar border
                g.DrawRectangle(barBorderPen, barX, barY, barW, barH);


                // ------------------------------------------------------------
                // Two numeric labels only — max and min
                // ------------------------------------------------------------

                g.DrawString(
                    maxValue.ToString("F2"),
                    labelFont,
                    textBrush,
                    labelX,
                    barY - 2
                );

                g.DrawString(
                    minValue.ToString("F2"),
                    labelFont,
                    textBrush,
                    labelX,
                    barY + barH - 14
                );
            }
        }

        return legend;
    }


    Color InterpolateColor(List<Color> colors, double t)
    {
        if (colors == null || colors.Count == 0)
            return Color.Black;

        if (colors.Count == 1)
            return colors[0];

        t = Math.Max(0.0, Math.Min(1.0, t));

        double scaled = t * (colors.Count - 1);
        int i0 = (int)Math.Floor(scaled);
        int i1 = Math.Min(i0 + 1, colors.Count - 1);

        double localT = scaled - i0;

        Color c0 = colors[i0];
        Color c1 = colors[i1];

        int a = (int)Math.Round(c0.A + (c1.A - c0.A) * localT);
        int r = (int)Math.Round(c0.R + (c1.R - c0.R) * localT);
        int g = (int)Math.Round(c0.G + (c1.G - c0.G) * localT);
        int b = (int)Math.Round(c0.B + (c1.B - c0.B) * localT);

        return Color.FromArgb(a, r, g, b);
    }


    class DrawLegendConduit : DisplayConduit
    {
        public Bitmap Legend;
        public string Token;

        protected override void DrawForeground(DrawEventArgs e)
        {
            string activeToken = RhinoDoc.ActiveDoc.Strings.GetValue(
                "GH_LEGEND_CONDUIT",
                "ACTIVE_TOKEN"
            );

            // If this conduit belongs to an old compiled script instance,
            // disable it automatically.
            if (activeToken != Token)
            {
                this.Enabled = false;

                if (Legend != null)
                {
                    Legend.Dispose();
                    Legend = null;
                }

                return;
            }

            if (Legend == null)
                return;

            e.Display.DrawBitmap(new DisplayBitmap(Legend), 50, 50);
        }
    }
}
# ---------- end c_script_5 ----------
